# Grasshopper definition Meta Chair.gh (Grasshopper 1.0.7)

seat_height = Slider(500, range=400..900)  # disabled
backrest_height = Slider(145, range=50..300)  # disabled
pt = ConstructPoint(XCoordinate=0, YCoordinate=0, ZCoordinate=0)  # disabled
number_slider = Slider(63, range=0..120)  # disabled
front_spread = Slider(0, range=0..100)  # disabled

# ----
# Parameters
seat_height_2 = Slider(300, range=200..900)
backrest_height_2 = Slider(401, range=50..500)
backrest_width = Slider(163, range=0..220)
leg_spread = Slider(452, range=300..500)
extra_front_spread = Slider(141, range=0..200)
seat_length = Slider(362, range=150..500)
seat_angle = Slider(8, range=0..8)
structure_thickness = Slider(80, range=20..160)
gap_width = Slider(20, range=0..100)
lower_cut = Slider(500, range=100..800)
bar_placement = Slider(16, range=5..40)
curvature = Slider(0, range=0..2)
rotation = Slider(0, range=-180..180)

# ----
# Parameter Set B
seat_height_3 = Slider(300, range=200..900)
backrest_height_3 = Slider(401, range=50..500)
leg_spread_2 = Slider(452, range=300..500)
seat_angle_2 = Slider(8, range=0..8)
structure_thickness_2 = Slider(80, range=20..160)
gap_width_2 = Slider(20, range=0..100)
bar_placement_2 = Slider(16, range=5..40)
curvature_2 = Slider(0, range=0..2)
backrest_width_2 = Slider(163, range=0..220)
extra_front_spread_2 = Slider(141, range=0..200)
seat_length_2 = Slider(362, range=150..500)
lower_cut_2 = Slider(500, range=100..800)
rotation_2 = Slider(0, range=-180..180)
entwine = Entwine(
    Branch00=seat_height_3,
    Branch01=backrest_height_3,
    Branch02=backrest_width_2,
    Branch03=leg_spread_2,
    Branch04=extra_front_spread_2,
    Branch05=seat_length_2,
    Branch06=seat_angle_2,
    Branch07=structure_thickness_2,
    Branch08=gap_width_2,
    Branch09=lower_cut_2,
    Branch010=bar_placement_2,
    Branch011=curvature_2,
    Branch012=rotation_2,
    Branch013=ColourSwatch(SwatchColor=RGB(0, 255, 255)),
    FlattenInputs=True)

# ----
# Parameter Set A
backrest_height_4 = Slider(410, range=50..410)
seat_angle_3 = Slider(3, range=0..8)
structure_thickness_3 = Slider(40, range=20..60)
gap_width_3 = Slider(30, range=0..100)
lower_cut_3 = Slider(300, range=100..800)
bar_placement_3 = Slider(21, range=5..40)
seat_height_4 = Slider(440, range=400..900)
backrest_width_3 = Slider(18, range=0..120)
leg_spread_3 = Slider(336, range=300..500)
extra_front_spread_3 = Slider(34, range=0..100)
seat_length_3 = Slider(350, range=350..500)
curvature_3 = Slider(0, range=0..2)
rotation_3 = Slider(0, range=-180..180)
entwine_2 = Entwine(
    Branch00=seat_height_4,
    Branch01=backrest_height_4,
    Branch02=backrest_width_3,
    Branch03=leg_spread_3,
    Branch04=extra_front_spread_3,
    Branch05=seat_length_3,
    Branch06=seat_angle_3,
    Branch07=structure_thickness_3,
    Branch08=gap_width_3,
    Branch09=lower_cut_3,
    Branch010=bar_placement_3,
    Branch011=curvature_3,
    Branch012=rotation_3,
    Branch013=ColourSwatch(SwatchColor=RGB(255, 0, 129)),
    FlattenInputs=True)

# ----
# Here is how you can blend between two sets of chair parameters
# Make sure you've enabled
# this node if you're using
# parameter blending
blend_control = Slider(0.5, range=0..1)
subtraction = Subtraction(A=1, B=blend_control)
cluster = Cluster_5(B=entwine, graph=subtraction)
cluster_2 = Cluster_5(B=entwine_2, graph=blend_control)
ma = MassAddition(Input=[cluster_2, cluster])  # -> Result, PartialResults
cluster_3 = Cluster_4(data=ma.Result)
pt_2 = ConstructPoint(XCoordinate=0, YCoordinate=0, ZCoordinate=0)
bang = ExplodeTree(Data=graft(cluster_3))  # -> Branch0, Branch1, Branch2, Branch3, Branch4, Branch5, Branch6, Branch7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
cluster_4 = Cluster_3(
    pt_2=pt_2,
    relay=bang.Branch0,
    relay_2=bang.Branch1,
    F=bang.Branch2,
    relay_3=bang.Branch3,
    relay_4=bang.Branch4,
    relay_5=bang.Branch5,
    relay_6=bang.Branch6,
    relay_7=bang.Branch7,
    relay_8=bang.Branch8,
    relay_9=bang.Branch9,
    relay_10=bang.Branch10,
    A=bang.Branch11,
    D=bang.Branch12,
    pt=bang.Branch13)  # -> brep_5, brep_6, crv_31, color; disabled
brep = Brep(cluster_4.brep_5)
crv = Curve(cluster_4.crv_31)
mesh = Mesh(cluster_4.brep_6)
mesh_2 = MeshBrep(
    Brep=brep,
    Settings={GridMaxCount=0, GridMinCount=16, JaggedSeams=False, MaxEdgeLength=0, MinEdgeLength=0.0001, MinTolerance=0, Refine=True, RefineAngle=0, RelativeTolerance=0.65, SimplePlanes=True, Tolerance=0})
preview = CustomPreview(Geometry=mesh_2, Material=cluster_4.color)
preview_2 = CustomPreview(Geometry=mesh, Material=ColourSwatch(SwatchColor=RGB(51, 51, 51)))
preview_3 = CustomPreview(Geometry=crv, Material=ColourSwatch(SwatchColor=RGB(0, 0, 0)))

width = Slider(374, range=300..500)  # disabled
seat_angle_rad = Slider(0.05, range=0..0.1)  # disabled
seat_length_4 = Slider(433, range=350..500)  # disabled
structure_thickness_4 = Slider(40, range=20..60)  # disabled
gap_cm = Slider(3, range=0..4)  # disabled
pt_3 = Point(pt)  # disabled
pt_4 = ConstructPoint(XCoordinate=0, YCoordinate=0, ZCoordinate=0)
number_slider_2 = Slider(1, range=0..1)  # disabled
addition = Addition(A=width, B=front_spread)  # disabled
number_slider_3 = Slider(1, range=0..1)  # disabled
number_slider_4 = Slider(1, range=0..1)  # disabled
cluster_5 = Cluster_3(
    pt_2=pt_4,
    relay=seat_height_2,
    relay_2=backrest_height_2,
    F=backrest_width,
    relay_3=leg_spread,
    relay_4=extra_front_spread,
    relay_5=seat_length,
    relay_6=seat_angle,
    relay_7=structure_thickness,
    relay_8=gap_width,
    relay_9=lower_cut,
    relay_10=bar_placement,
    A=curvature,
    D=rotation,
    pt=ColourSwatch(SwatchColor=RGB(0, 255, 255)))  # -> brep_5, brep_6, crv_31, color
Y = UnitY(Factor=number_slider)  # disabled
Z = UnitZ(Factor=seat_height)  # disabled
Z_2 = UnitZ(Factor=backrest_height)  # disabled
number_slider_5 = Slider(0, range=0..1)  # disabled
smoothing_degree = Slider(2, range=2..3)  # disabled

leg_thickness = Slider(0.21, range=0..1)  # disabled
cut_height = Slider(0.6, range=0.3..0.8)  # disabled

bar_placement_4 = Slider(0.16, range=0.05..0.4)  # disabled
panel = Panel("1")  # disabled
panel_2 = Panel("1")  # disabled
X = UnitX(Factor=width)  # disabled
panel_3 = Panel("1")  # disabled
X_2 = UnitX(Factor=width)  # disabled
X_3 = UnitX(Factor=addition)  # disabled
panel_4 = Panel("-0.25")  # disabled
panel_5 = Panel("-0.25")  # disabled
panel_6 = Panel("-0.75")  # disabled
subtraction_2 = Subtraction(A=panel, B=number_slider_3)  # disabled
pi = Pi(Factor=panel_4)  # disabled
pi_2 = Pi(Factor=panel_6)  # disabled
pi_3 = Pi(Factor=panel_5)  # disabled
subtraction_3 = Subtraction(A=panel_2, B=number_slider_2)  # disabled
subtraction_4 = Subtraction(A=panel_3, B=number_slider_4)  # disabled
brep_2 = Brep(cluster_5.brep_5)
crv_2 = Curve(cluster_5.crv_31)
mesh_3 = Mesh(cluster_5.brep_6)
panel_7 = Panel("350")  # disabled
panel_8 = Panel("150")  # disabled
mesh_4 = MeshBrep(
    Brep=brep_2,
    Settings={GridMaxCount=0, GridMinCount=16, JaggedSeams=False, MaxEdgeLength=0, MinEdgeLength=0.0001, MinTolerance=0, Refine=True, RefineAngle=0, RelativeTolerance=0.65, SimplePlanes=True, Tolerance=0})
panel_9 = Panel("430")  # disabled
panel_10 = Panel("375")  # disabled
panel_11 = Panel("300")  # disabled
panel_12 = Panel("380")  # disabled
panel_13 = Panel("0")  # disabled
panel_14 = Panel("100")  # disabled
cluster_6 = Cluster_2(graph=number_slider_3, A=panel_7, B=panel_8)  # disabled
panel_15 = Panel("40")  # disabled
panel_16 = Panel("120")  # disabled
panel_17 = Panel("40")  # disabled
panel_18 = Panel("120")  # disabled
panel_19 = Panel("300")  # disabled
panel_20 = Panel("500")  # disabled
cluster_7 = Cluster_2(graph=subtraction_4, A=panel_9, B=panel_12)  # disabled
cluster_8 = Cluster_2(graph=subtraction_3, A=panel_10, B=panel_11)  # disabled
cluster_9 = Cluster_2(graph=subtraction_3, A=panel_13, B=panel_14)  # disabled
preview_4 = CustomPreview(Geometry=mesh_4, Material=cluster_5.color)
preview_5 = CustomPreview(Geometry=mesh_3, Material=ColourSwatch(SwatchColor=RGB(51, 51, 51)))
preview_6 = CustomPreview(Geometry=crv_2, Material=ColourSwatch(SwatchColor=RGB(0, 0, 0)))
seat_height_5 = Slider(500, range=400..900)  # disabled
pt_5 = ConstructPoint(XCoordinate=0, YCoordinate=0, ZCoordinate=0)  # disabled
cluster_10 = Cluster_2(graph=subtraction_4, A=panel_15, B=panel_16)  # disabled
backrest_height_5 = Slider(145, range=50..300)  # disabled
cluster_11 = Cluster_2(graph=number_slider_5, A=panel_17, B=panel_18)  # disabled
width_2 = Slider(375, range=300..500)  # disabled
cluster_12 = Cluster_2(graph=number_slider_3, A=panel_19, B=panel_20)  # disabled
number_slider_6 = Slider(63, range=0..120)  # disabled
front_spread_2 = Slider(100, range=0..100)  # disabled
seat_angle_rad_2 = Slider(0.05, range=0..0.1)  # disabled
structure_thickness_5 = Slider(40, range=20..60)  # disabled
seat_length_5 = Slider(380, range=350..500)  # disabled
gap_cm_2 = Slider(3, range=0..4)  # disabled
multiplication = Multiplication(A=gap_cm, B=10)  # disabled
pt_6 = Point(pt_5)  # disabled
xy = XYPlane(Origin=Point(0, 0, 0))  # disabled
addition_2 = Addition(A=cluster_8, B=cluster_9)  # disabled
division = Division(A=structure_thickness_4, B=2)  # disabled
Z_3 = UnitZ(Factor=division)  # disabled
move = Move(Geometry=pt_3, Motion=Z_3)  # -> Geometry, Transform; disabled
subtraction_5 = Subtraction(A=Z, B=Z_3)  # disabled
move_2 = Move(Geometry=move.Geometry, Motion=X)  # -> Geometry, Transform; disabled
move_3 = Move(Geometry=move.Geometry, Motion=X_2)  # -> Geometry, Transform; disabled
move_4 = Move(Geometry=move.Geometry, Motion=X_3)  # -> Geometry, Transform; disabled
addition_3 = Addition(A=Z_2, B=subtraction_5, C=Y)  # disabled
rotate = Rotate(Geometry=move_2.Geometry, Angle=pi, Plane=move.Geometry)  # -> Geometry, Transform; disabled
rotate_2 = Rotate(Geometry=move_3.Geometry, Angle=pi_2, Plane=move.Geometry)  # -> Geometry, Transform; disabled
rotate_3 = Rotate(Geometry=move_4.Geometry, Angle=pi_3, Plane=move.Geometry)  # -> Geometry, Transform; disabled
pt_7 = Point(rotate_2.Geometry)  # disabled
pt_8 = Point(rotate_3.Geometry)  # disabled
yz = YZPlane(Origin=rotate.Geometry)  # disabled
move_5 = Move(Geometry=rotate_2.Geometry, Motion=addition_3)  # -> Geometry, Transform; disabled
pt_9 = Point(move_5.Geometry)  # disabled
srf4pt = _4PointSurface(CornerA=pt_8, CornerB=pt_7, CornerC=pt_9)  # disabled
ln = Line(StartPoint=pt_8, EndPoint=pt_7)  # disabled
move_6 = Move(Geometry=xy, Motion=subtraction_5)  # -> Geometry, Transform; disabled
Y_2 = UnitY(Factor=number_slider_6)  # disabled
Z_4 = UnitZ(Factor=cluster_12)  # disabled
Z_5 = UnitZ(Factor=cluster_6)  # disabled
smoothing_degree_2 = Slider(2, range=2..3)  # disabled

leg_thickness_2 = Slider(0.21, range=0..1)  # disabled
cut_height_2 = Slider(0.6, range=0.3..0.8)  # disabled

bar_placement_5 = Slider(0.16, range=0.05..0.4)  # disabled
X_4 = UnitX(Factor=cluster_8)  # disabled
X_5 = UnitX(Factor=cluster_8)  # disabled
X_6 = UnitX(Factor=addition_2)  # disabled
panel_21 = Panel("-0.25")  # disabled
panel_22 = Panel("-0.25")  # disabled
sec = BrepPlane(Brep=srf4pt, Plane=move_6.Geometry)  # -> Curves, Points; disabled
plx = LinePlane(Line=sec.Curves, Plane=yz)  # -> Point, ParamL, ParamP; disabled
panel_23 = Panel("-0.75")  # disabled
pi_4 = Pi(Factor=panel_21)  # disabled
pi_5 = Pi(Factor=panel_23)  # disabled
pi_6 = Pi(Factor=panel_22)  # disabled
end = EndPoints(Curve=sec.Curves)  # -> Start, End; disabled
dist = Distance(PointA=plx.Point, PointB=end.End)  # disabled
min = Minimum(A=seat_length_4, B=dist)  # disabled
data = Data(leg_thickness)  # disabled
data_2 = Data(cut_height)  # disabled
data_3 = Data(division)  # disabled
xz = XZPlane(Origin=Point(0, 0, 0))  # disabled
vec2pt = Vector2Pt(PointA=plx.Point, PointB=end.End, Unitize=False)  # -> Vector, Length; disabled
amp = Amplitude(Vector=vec2pt.Vector, Amplitude=min)  # disabled
pi_7 = Pi(Factor=seat_angle_rad)  # disabled
move_7 = Move(Geometry=plx.Point, Motion=amp)  # -> Geometry, Transform; disabled
pln = Plane(srf4pt)  # disabled
neg = Negative(Value=pi_7)  # disabled
vec = Vector(pln)  # disabled
ln_2 = Line(StartPoint=plx.Point, EndPoint=move_7.Geometry)  # disabled
crv_3 = Curve(ln_2)  # disabled
end_2 = EndPoints(Curve=crv_3)  # -> Start, End; disabled
multiplication_2 = Multiplication(A=gap_cm_2, B=10)  # disabled
rot3d = Rotate3D(Geometry=ln_2, Angle=neg, Center=end_2.End, Axis=vec)  # -> Geometry, Transform; disabled
data_4 = Data(multiplication)  # disabled
data_5 = Data(multiplication)  # disabled
xy_2 = XYPlane(Origin=Point(0, 0, 0))  # disabled
data_6 = Data(xz)  # disabled
neg_2 = Negative(Value=data_4)  # disabled
division_2 = Division(A=cluster_10, B=2)  # disabled
Z_6 = UnitZ(Factor=division_2)  # disabled
move_8 = Move(Geometry=pt_6, Motion=Z_6)  # -> Geometry, Transform; disabled
subtraction_6 = Subtraction(A=Z_4, B=Z_6)  # disabled
move_9 = Move(Geometry=move_8.Geometry, Motion=X_4)  # -> Geometry, Transform; disabled
move_10 = Move(Geometry=move_8.Geometry, Motion=X_5)  # -> Geometry, Transform; disabled
move_11 = Move(Geometry=move_8.Geometry, Motion=X_6)  # -> Geometry, Transform; disabled
addition_4 = Addition(A=Z_5, B=subtraction_6, C=Y_2)  # disabled
rotate_4 = Rotate(Geometry=move_9.Geometry, Angle=pi_4, Plane=move_8.Geometry)  # -> Geometry, Transform; disabled
rotate_5 = Rotate(Geometry=move_10.Geometry, Angle=pi_5, Plane=move_8.Geometry)  # -> Geometry, Transform; disabled
rotate_6 = Rotate(Geometry=move_11.Geometry, Angle=pi_6, Plane=move_8.Geometry)  # -> Geometry, Transform; disabled
pt_10 = Point(rotate_5.Geometry)  # disabled
pt_11 = Point(rotate_6.Geometry)  # disabled
yz_2 = YZPlane(Origin=rotate_4.Geometry)  # disabled
move_12 = Move(Geometry=rotate_5.Geometry, Motion=addition_4)  # -> Geometry, Transform; disabled
pt_12 = Point(move_12.Geometry)  # disabled
srf4pt_2 = _4PointSurface(CornerA=pt_11, CornerB=pt_10, CornerC=pt_12)  # disabled
ln_3 = Line(StartPoint=pt_11, EndPoint=pt_10)  # disabled
move_13 = Move(Geometry=xy_2, Motion=subtraction_6)  # -> Geometry, Transform; disabled
sec_2 = BrepPlane(Brep=srf4pt_2, Plane=move_13.Geometry)  # -> Curves, Points; disabled
plx_2 = LinePlane(Line=sec_2.Curves, Plane=yz_2)  # -> Point, ParamL, ParamP; disabled
data_7 = Data(srf4pt)  # disabled
end_3 = EndPoints(Curve=sec_2.Curves)  # -> Start, End; disabled
dist_2 = Distance(PointA=plx_2.Point, PointB=end_3.End)  # disabled
min_2 = Minimum(A=seat_length_5, B=dist_2)  # disabled
data_8 = Data(leg_thickness_2)  # disabled
data_9 = Data(cut_height_2)  # disabled
data_10 = Data(division_2)  # disabled
xz_2 = XZPlane(Origin=Point(0, 0, 0))  # disabled
vec2pt_2 = Vector2Pt(PointA=plx_2.Point, PointB=end_3.End, Unitize=False)  # -> Vector, Length; disabled
amp_2 = Amplitude(Vector=vec2pt_2.Vector, Amplitude=min_2)  # disabled
pi_8 = Pi(Factor=seat_angle_rad_2)  # disabled
move_14 = Move(Geometry=plx_2.Point, Motion=amp_2)  # -> Geometry, Transform; disabled
pln_2 = Plane(srf4pt_2)  # disabled
neg_3 = Negative(Value=pi_8)  # disabled
vec_2 = Vector(pln_2)  # disabled
ln_4 = Line(StartPoint=plx_2.Point, EndPoint=move_14.Geometry)  # disabled
crv_4 = Curve(ln_4)  # disabled
end_4 = EndPoints(Curve=crv_4)  # -> Start, End; disabled
rot3d_2 = Rotate3D(Geometry=ln_4, Angle=neg_3, Center=end_4.End, Axis=vec_2)  # -> Geometry, Transform; disabled
data_11 = Data(multiplication_2)  # disabled
data_12 = Data(multiplication_2)  # disabled
data_13 = Data(xz_2)  # disabled
neg_4 = Negative(Value=data_11)  # disabled
data_14 = Data(srf4pt_2)  # disabled
xy_3 = XYPlane(Origin=move.Geometry)  # disabled
line = Line(rot3d.Geometry)  # disabled
data_15 = Data(pt_7)  # disabled
flip = FlipCurve(Curve=line)  # -> Curve, Flag; disabled
end_5 = EndPoints(Curve=flip.Curve)  # -> Start, End; disabled
data_16 = Data(pt_8)  # disabled
data_17 = Data(end_5.Start)  # disabled
data_18 = Data(pt_9)  # disabled
data_19 = Data(end_5.End)  # disabled
vec2pt_3 = Vector2Pt(PointA=data_19, PointB=data_16, Unitize=False)  # -> Vector, Length; disabled
data_20 = Data(vec)  # disabled
vec2pt_4 = Vector2Pt(PointA=end_5.Start, PointB=data_15, Unitize=False)  # -> Vector, Length; disabled
projecta = ProjectAlong(Geometry=data_16, Plane=xy_3, Direction=vec2pt_3.Vector)  # -> Geometry, Transform; disabled
projecta_2 = ProjectAlong(Geometry=data_15, Plane=xy_3, Direction=vec2pt_4.Vector)  # -> Geometry, Transform; disabled
ln_5 = Line(StartPoint=data_19, EndPoint=projecta.Geometry)  # disabled
ln_6 = Line(StartPoint=data_17, EndPoint=data_18)  # disabled
ln_7 = Line(StartPoint=end_5.Start, EndPoint=projecta_2.Geometry)  # disabled
pt_13 = Point(data_18)  # disabled
xy_4 = XYPlane(Origin=move_8.Geometry)  # disabled
line_2 = Line(rot3d_2.Geometry)  # disabled
data_21 = Data(pt_10)  # disabled
flip_2 = FlipCurve(Curve=line_2)  # -> Curve, Flag; disabled
end_6 = EndPoints(Curve=flip_2.Curve)  # -> Start, End; disabled
data_22 = Data(pt_11)  # disabled
data_23 = Data(end_6.Start)  # disabled
data_24 = Data(pt_12)  # disabled
data_25 = Data(end_6.End)  # disabled
vec2pt_5 = Vector2Pt(PointA=data_25, PointB=data_22, Unitize=False)  # -> Vector, Length; disabled
data_26 = Data(vec_2)  # disabled
vec2pt_6 = Vector2Pt(PointA=end_6.Start, PointB=data_21, Unitize=False)  # -> Vector, Length; disabled
projecta_3 = ProjectAlong(Geometry=data_22, Plane=xy_4, Direction=vec2pt_5.Vector)  # -> Geometry, Transform; disabled
crv_5 = Curve(graft([ln_6, ln_7, ln_5]))  # disabled
projecta_4 = ProjectAlong(Geometry=data_21, Plane=xy_4, Direction=vec2pt_6.Vector)  # -> Geometry, Transform; disabled
data_27 = Data(xz)  # disabled
Y_3 = UnitY(Factor=neg_2)  # disabled
curvepoint = PointOnCurve(crv_5, parameter=0.667)  # disabled
ln_8 = Line(StartPoint=data_25, EndPoint=projecta_3.Geometry)  # disabled
end_7 = EndPoints(Curve=crv_5)  # -> Start, End; disabled
ln_9 = Line(StartPoint=data_23, EndPoint=data_24)  # disabled
ln_10 = Line(StartPoint=end_6.Start, EndPoint=projecta_4.Geometry)  # disabled
data_28 = Data(crv_5)  # disabled
vec_3 = Vector(data_20)  # disabled
pt_14 = Point(data_24)  # disabled
data_29 = Data(flip.Curve)  # disabled
pt_15 = Point(end_7.Start)  # disabled
move_15 = Move(Geometry=data_27, Motion=Y_3)  # -> Geometry, Transform; disabled
pt_16 = Point(end_7.End)  # disabled
data_30 = Data(move_15.Geometry)  # disabled
data_31 = Data(pt_15)  # disabled
projecta_5 = ProjectAlong(Geometry=data_29, Plane=data_30, Direction=vec_3)  # -> Geometry, Transform; disabled
project = Project(Geometry=curvepoint, Plane=data_30)  # -> Geometry, Transform; disabled
projecta_6 = ProjectAlong(Geometry=data_31, Plane=data_30, Direction=vec_3)  # -> Geometry, Transform; disabled
geo = Geometry(srf4pt)  # disabled
pl_origin = PlaneOrigin(Base=xy_3, Origin=pt_16)  # disabled
vec2pt_7 = Vector2Pt(PointA=projecta_6.Geometry, PointB=project.Geometry, Unitize=False)  # -> Vector, Length; disabled
data_32 = Data(data_28)  # disabled
projecta_7 = ProjectAlong(Geometry=project.Geometry, Plane=pl_origin, Direction=vec2pt_7.Vector)  # -> Geometry, Transform; disabled
panel_24 = Panel("1")  # disabled
ln_11 = Line(StartPoint=projecta_6.Geometry, EndPoint=projecta_7.Geometry)  # disabled
pln_3 = Plane(geo)  # disabled
item = ListItem(List=flatten(projecta_6.Geometry), Index=0, Wrap=True)  # disabled
item_2 = ListItem(List=flatten(projecta_7.Geometry), Index=0, Wrap=True)  # disabled
item_3 = ListItem(List=flatten(projecta_7.Geometry), Index=panel_24, Wrap=True)  # disabled
data_33 = Data(projecta_5.Geometry)  # disabled
cluster_13 = Cluster(crv_2=data_29, crv=projecta_5.Geometry)  # disabled
data_34 = Data(data_30)  # disabled
pln_4 = Plane(geo)  # disabled
cluster_14 = Cluster(crv_2=data_32, crv=ln_11)  # -> flatten(L); disabled
pull = PullPoint(Point=item_2, Geometry=pln_3, ClosestOnly=True)  # -> ClosestPoint, Distance; disabled
crv_6 = Curve(graft([ln_9, ln_10, ln_8]))  # disabled
pull_2 = PullPoint(Point=item_3, Geometry=pln_4, ClosestOnly=True)  # -> ClosestPoint, Distance; disabled
data_35 = Data(xz_2)  # disabled
Y_4 = UnitY(Factor=neg_4)  # disabled
curvepoint_2 = PointOnCurve(crv_6, parameter=0.667)  # disabled
srf = Surface(flatten([cluster_14, cluster_13]))  # disabled
end_8 = EndPoints(Curve=crv_6)  # -> Start, End; disabled
data_36 = Data(crv_6)  # disabled
vec_4 = Vector(data_26)  # disabled
data_37 = Data(flip_2.Curve)  # disabled
pt_17 = Point(end_8.Start)  # disabled
move_16 = Move(Geometry=data_35, Motion=Y_4)  # -> Geometry, Transform; disabled
subtraction_7 = Subtraction(A=pull_2.Distance, B=pull.Distance)  # disabled
item_4 = ListItem(List=srf, Index=0, Wrap=True)  # -> Item, Item1, Item2, Item3; disabled
vec2pt_8 = Vector2Pt(PointA=item_3, PointB=pull_2.ClosestPoint, Unitize=False)  # -> Vector, Length; disabled
pt_18 = Point(end_8.End)  # disabled
data_38 = Data(move_16.Geometry)  # disabled
data_39 = Data(pt_17)  # disabled
data_40 = Data(item_2)  # disabled
data_41 = Data(item)  # disabled
data_42 = Data(item_3)  # disabled
amp_3 = Amplitude(Vector=vec2pt_8.Vector, Amplitude=subtraction_7)  # disabled
join = BrepJoin(Breps=[item_4.Item1, item_4.Item2, item_4.Item3])  # -> Breps, Closed; disabled
join_2 = BrepJoin(Breps=[item_4.Item, item_4.Item1])  # -> Breps, Closed; disabled
join_3 = BrepJoin(Breps=[item_4.Item, item_4.Item3, item_4.Item2])  # -> Breps, Closed; disabled
line_3 = Line(data_33)  # disabled
projecta_8 = ProjectAlong(Geometry=data_37, Plane=data_38, Direction=vec_4)  # -> Geometry, Transform; disabled
project_2 = Project(Geometry=curvepoint_2, Plane=data_38)  # -> Geometry, Transform; disabled
move_17 = Move(Geometry=item_3, Motion=amp_3)  # -> Geometry, Transform; disabled
pln_5 = Plane(data_7)  # disabled
pln_6 = Plane(data_34)  # disabled
projecta_9 = ProjectAlong(Geometry=data_39, Plane=data_38, Direction=vec_4)  # -> Geometry, Transform; disabled
panel_25 = Panel("2")  # disabled
geo_2 = Geometry(srf4pt_2)  # disabled
pln_7 = Plane(pln_6)  # disabled
pln_8 = Plane(pln_5)  # disabled
pl_origin_2 = PlaneOrigin(Base=xy_4, Origin=pt_18)  # disabled
vec2pt_9 = Vector2Pt(PointA=projecta_9.Geometry, PointB=project_2.Geometry, Unitize=False)  # -> Vector, Length; disabled
nurbs = NurbsCurve(Vertices=[data_40, data_41, move_17.Geometry], Degree=panel_25, Periodic=False)  # -> Curve, Length, Domain; disabled
data_43 = Data(data_36)  # disabled
data_44 = Data(line_3)  # disabled
len = Length(Curve=line_3)  # disabled
data_45 = Data([join_2.Breps, join.Breps, join_3.Breps])  # disabled
projecta_10 = ProjectAlong(Geometry=project_2.Geometry, Plane=pl_origin_2, Direction=vec2pt_9.Vector)  # -> Geometry, Transform; disabled
ext = ExtendCurve(Curve=data_44, Type=0, Start=len, End=len)  # disabled
len_2 = Length(Curve=nurbs.Curve)  # disabled
panel_26 = Panel("1")  # disabled
ln_12 = Line(StartPoint=projecta_9.Geometry, EndPoint=projecta_10.Geometry)  # disabled
pln_9 = Plane(geo_2)  # disabled

sec_3 = BrepPlane(Brep=data_45, Plane=pln_7)  # -> graft(Curves), Points; disabled
sec_4 = BrepPlane(Brep=data_45, Plane=pln_8)  # -> graft(Curves), Points; disabled

ext_2 = ExtendCurve(Curve=nurbs.Curve, Type=0, Start=len_2, End=len_2)  # disabled
item_5 = ListItem(List=flatten(projecta_9.Geometry), Index=0, Wrap=True)  # disabled
item_6 = ListItem(List=flatten(projecta_10.Geometry), Index=0, Wrap=True)  # disabled
item_7 = ListItem(List=flatten(projecta_10.Geometry), Index=panel_26, Wrap=True)  # disabled
data_46 = Data(projecta_8.Geometry)  # disabled
end_9 = EndPoints(Curve=ext)  # -> Start, End; disabled
cluster_15 = Cluster(crv_2=data_37, crv=projecta_8.Geometry)  # disabled
cluster_16 = Cluster(crv_2=data_43, crv=ln_12)  # -> flatten(L); disabled
data_47 = Data(data_38)  # disabled
pln_10 = Plane(geo_2)  # disabled
pull_3 = PullPoint(Point=item_6, Geometry=pln_9, ClosestOnly=True)  # -> ClosestPoint, Distance; disabled
vec2pt_10 = Vector2Pt(PointA=end_9.Start, PointB=end_9.End, Unitize=False)  # -> Vector, Length; disabled
flip_3 = FlipCurve(Curve=sec_4.Curves)  # -> Curve, Flag; disabled
pull_4 = PullPoint(Point=item_7, Geometry=pln_10, ClosestOnly=True)  # -> ClosestPoint, Distance; disabled
rev = Reverse(Vector=vec2pt_10.Vector)  # disabled
vec_5 = Vector(vec2pt_10.Vector)  # disabled
panel_27 = Panel("0.3")  # disabled
explode = Explode(Curve=sec_3.Curves, Recursive=True)  # -> Segments, Vertices; disabled
explode_2 = Explode(Curve=flip_3.Curve, Recursive=True)  # -> Segments, Vertices; disabled
srf_2 = Surface(flatten([cluster_16, cluster_15]))  # disabled
extr = Extrude(Base=ext_2, Direction=vec_5)  # disabled
multiplication_3 = Multiplication(A=rev, B=panel_27)  # disabled
subtraction_8 = Subtraction(A=pull_4.Distance, B=pull_3.Distance)  # disabled
item_8 = ListItem(List=srf_2, Index=0, Wrap=True)  # -> Item, Item1, Item2, Item3; disabled
vec2pt_11 = Vector2Pt(PointA=item_7, PointB=pull_4.ClosestPoint, Unitize=False)  # -> Vector, Length; disabled
number_slider_7 = Slider(200, range=50..200)  # disabled
move_18 = Move(Geometry=extr, Motion=multiplication_3)  # -> Geometry, Transform; disabled
entwine_3 = Entwine(Branch0X=explode.Segments, Branch1X=explode_2.Segments, FlattenInputs=False)  # disabled
data_48 = Data(item_6)  # disabled
data_49 = Data(item_5)  # disabled
data_50 = Data(item_7)  # disabled
crv_7 = Curve(flatten(explode_2.Segments))  # disabled
amp_4 = Amplitude(Vector=vec2pt_11.Vector, Amplitude=subtraction_8)  # disabled
crv_8 = Curve(flatten(explode.Segments))  # disabled
join_4 = BrepJoin(Breps=[item_8.Item1, item_8.Item2, item_8.Item3])  # -> Breps, Closed; disabled
join_5 = BrepJoin(Breps=[item_8.Item, item_8.Item1])  # -> Breps, Closed; disabled
join_6 = BrepJoin(Breps=[item_8.Item, item_8.Item3, item_8.Item2])  # -> Breps, Closed; disabled
panel_28 = Panel("2")  # disabled
line_4 = Line(data_46)  # disabled
crv_9 = Curve(entwine_3)  # disabled
move_19 = Move(Geometry=item_7, Motion=amp_4)  # -> Geometry, Transform; disabled
pln_11 = Plane(data_14)  # disabled
pln_12 = Plane(data_47)  # disabled
item_9 = ListItem(List=crv_7, Index=0, Wrap=True)  # -> Item, Item1, Item2, Item3, Item4; disabled
item_10 = ListItem(List=crv_8, Index=0, Wrap=True)  # -> Item, Item1, Item2, Item3, Item4; disabled
panel_29 = Panel("2")  # disabled
len_3 = Length(Curve=crv_9)  # disabled
pln_13 = Plane(pln_12)  # disabled
pln_14 = Plane(pln_11)  # disabled
subtraction_9 = Subtraction(A=smoothing_degree, B=1)  # disabled
data_51 = Data(subtraction_9)  # disabled
nurbs_2 = NurbsCurve(Vertices=[data_48, data_49, move_19.Geometry], Degree=panel_29, Periodic=False)  # -> Curve, Length, Domain; disabled
len_4 = Length(Curve=line_4)  # disabled
data_52 = Data(line_4)  # disabled
crv_10 = Curve(item_9.Item2)  # disabled
crv_11 = Curve(item_9.Item4)  # disabled
crv_12 = Curve(item_10.Item2)  # disabled
crv_13 = Curve(item_10.Item4)  # disabled
division_3 = Division(A=len_3, B=number_slider_7)  # disabled
data_53 = Data([join_5.Breps, join_4.Breps, join_6.Breps])  # disabled
panel_30 = Panel("2")  # disabled
flip_4 = FlipCurve(Curve=crv_10)  # -> Curve, Flag; disabled
flip_5 = FlipCurve(Curve=crv_12)  # -> Curve, Flag; disabled
ext_3 = ExtendCurve(Curve=data_52, Type=0, Start=len_4, End=len_4)  # disabled
len_5 = Length(Curve=nurbs_2.Curve)  # disabled
round = Round(Number=division_3)  # -> Nearest, Floor, Ceiling; disabled
max = Maximum(A=round.Nearest, B=panel_30)  # disabled
crv_14 = Curve(item_9.Item1)  # disabled
crv_15 = Curve(item_10.Item1)  # disabled
divide = DivideCurve(Curve=crv_9, Count=smoothing_degree, Kinks=False)  # -> Points, Tangents, Parameters; disabled

sec_5 = BrepPlane(Brep=data_53, Plane=pln_13)  # -> graft(Curves), Points; disabled
sec_6 = BrepPlane(Brep=data_53, Plane=pln_14)  # -> graft(Curves), Points; disabled

ext_4 = ExtendCurve(Curve=nurbs_2.Curve, Type=0, Start=len_5, End=len_5)  # disabled
end_10 = EndPoints(Curve=ext_3)  # -> Start, End; disabled
trim = TrimTree(Tree=divide.Points, Depth=1)  # disabled
vec2pt_12 = Vector2Pt(PointA=end_10.Start, PointB=end_10.End, Unitize=False)  # -> Vector, Length; disabled

pline = PolyLine(Vertices=trim, Closed=False)  # disabled
cp = ControlPoints(Curve=pline)  # -> Points, Weights, Knots; disabled

flip_6 = FlipCurve(Curve=sec_6.Curves)  # -> Curve, Flag; disabled
rev_2 = Reverse(Vector=vec2pt_12.Vector)  # disabled
vec_6 = Vector(vec2pt_12.Vector)  # disabled
panel_31 = Panel("0.3")  # disabled
explode_3 = Explode(Curve=sec_5.Curves, Recursive=True)  # -> Segments, Vertices; disabled
explode_4 = Explode(Curve=flip_6.Curve, Recursive=True)  # -> Segments, Vertices; disabled
nurbs_3 = NurbsCurve(Vertices=cp.Points, Degree=3, Periodic=False)  # -> Curve, Length, Domain; disabled
extr_2 = Extrude(Base=ext_4, Direction=vec_6)  # disabled
multiplication_4 = Multiplication(A=rev_2, B=panel_31)  # disabled
simplify = SimplifyTree(Tree=nurbs_3.Curve, Front=False)  # disabled
panel_32 = Panel("{0;*}")  # disabled
number_slider_8 = Slider(200, range=50..200)  # disabled
move_20 = Move(Geometry=extr_2, Motion=multiplication_4)  # -> Geometry, Transform; disabled
entwine_4 = Entwine(Branch0X=explode_3.Segments, Branch1X=explode_4.Segments, FlattenInputs=False)  # disabled
split = SplitTree(Data=simplify, Masks=flatten(panel_32))  # -> flatten(Positive), flatten(Negative); disabled
crv_16 = Curve(flatten(explode_4.Segments))  # disabled
crv_17 = Curve(flatten(explode_3.Segments))  # disabled
data_54 = Data(flip_4.Curve)  # disabled
data_55 = Data(flip_5.Curve)  # disabled
data_56 = Data(crv_13)  # disabled
data_57 = Data(crv_11)  # disabled
crv_18 = Curve(entwine_4)  # disabled
item_11 = ListItem(List=crv_16, Index=0, Wrap=True)  # -> Item, Item1, Item2, Item3, Item4; disabled
item_12 = ListItem(List=crv_17, Index=0, Wrap=True)  # -> Item, Item1, Item2, Item3, Item4; disabled
graft = GraftTree(Tree=split.Negative, IncludeEmptyLists=True, IncludeNullItems=True)  # disabled
graft_2 = GraftTree(Tree=split.Positive, IncludeEmptyLists=True, IncludeNullItems=True)  # disabled
len_6 = Length(Curve=crv_18)  # disabled
crv_19 = Curve([data_54, data_55])  # disabled
crv_20 = Curve([data_57, data_56])  # disabled
subtraction_10 = Subtraction(A=smoothing_degree_2, B=1)  # disabled
data_58 = Data(subtraction_10)  # disabled
data_59 = Data(division)  # disabled
crv_21 = Curve(item_11.Item2)  # disabled
crv_22 = Curve(item_11.Item4)  # disabled
crv_23 = Curve(item_12.Item2)  # disabled
crv_24 = Curve(item_12.Item4)  # disabled
division_4 = Division(A=len_6, B=number_slider_8)  # disabled
item_13 = ListItem(List=crv_20, Index=0, Wrap=True)  # -> Item, Item1; disabled
item_14 = ListItem(List=crv_19, Index=0, Wrap=True)  # -> Item, Item1; disabled
panel_34 = Panel("2")  # disabled
flip_7 = FlipCurve(Curve=crv_21)  # -> Curve, Flag; disabled
flip_8 = FlipCurve(Curve=crv_23)  # -> Curve, Flag; disabled
crv_25 = Curve(flatten(graft))  # disabled
round_2 = Round(Number=division_4)  # -> Nearest, Floor, Ceiling; disabled
max_2 = Maximum(A=round_2.Nearest, B=panel_34)  # disabled
crv_26 = Curve(item_11.Item1)  # disabled
crv_27 = Curve(item_12.Item1)  # disabled
divide_2 = DivideCurve(Curve=crv_18, Count=smoothing_degree_2, Kinks=False)  # -> Points, Tangents, Parameters; disabled
item_15 = ListItem(List=flatten(graft_2), Index=0, Wrap=True)  # -> Item, Item1, Item2; disabled
data_60 = Data(data_6)  # disabled
panel_35 = Panel("1")  # disabled
end_11 = EndPoints(Curve=crv_19)  # -> Start, End; disabled
end_12 = EndPoints(Curve=crv_20)  # -> Start, End; disabled
crv_28 = Curve(flatten(graft_2))  # disabled
data_61 = Data(pln_5)  # disabled
item_16 = ListItem(List=crv_25, Index=0, Wrap=True)  # -> Item, Item1; disabled
subtraction_11 = Subtraction(A=panel_35, B=bar_placement_4)  # disabled
trim_2 = TrimTree(Tree=divide_2.Points, Depth=1)  # disabled
entwine_5 = Entwine(Branch00=end_12.Start, Branch01=end_12.End, FlattenInputs=True)  # disabled
entwine_6 = Entwine(Branch00=end_11.Start, Branch01=end_11.End, FlattenInputs=True)  # disabled
crv_29 = Curve(item_15.Item1)  # disabled

pline_2 = PolyLine(Vertices=trim_2, Closed=False)  # disabled
cp_2 = ControlPoints(Curve=pline_2)  # -> Points, Weights, Knots; disabled

data_62 = Data(data_59)  # disabled
end_13 = EndPoints(Curve=item_16.Item)  # -> Start, End; disabled
end_14 = EndPoints(Curve=item_16.Item1)  # -> Start, End; disabled
panel_36 = Panel("1")  # disabled
panel_37 = Panel("-1")  # disabled
panel_38 = Panel("-1")  # disabled
xz_3 = XZPlane(Origin=Point(0, 0, 0))  # disabled
pline_3 = PolyLine(Vertices=entwine_5, Closed=False)  # disabled
pline_4 = PolyLine(Vertices=entwine_6, Closed=False)  # disabled
data_63 = Data([panel_37, panel_36, panel_38])  # disabled
eval = EvaluateCurve(Curve=reparameterize(crv_29), Parameter=bar_placement_4)  # -> Point, Tangent, Angle; disabled
eval_2 = EvaluateCurve(Curve=reparameterize(crv_29), Parameter=subtraction_11)  # -> Point, Tangent, Angle; disabled
panel_39 = Panel("1")  # disabled
data_64 = Data(data)  # disabled
panel_40 = Panel("-1")  # disabled
data_65 = Data(data_2)  # disabled
data_66 = Data(data_51)  # disabled
nurbs_4 = NurbsCurve(Vertices=cp_2.Points, Degree=3, Periodic=False)  # -> Curve, Length, Domain; disabled
neg_5 = Negative(Value=data_62)  # disabled
pl_3pt = Plane3Pt(PointA=end_13.Start, PointB=end_13.End, PointC=end_14.End)  # disabled
panel_41 = Panel("1")  # disabled
data_67 = Data([panel_39, panel_40, panel_41])  # disabled
multiplication_5 = Multiplication(A=data_62, B=data_63)  # disabled
crv_30 = Curve([pline_4, pline_3])  # disabled
end_15 = EndPoints(Curve=crv_30)  # -> Start, End; disabled
simplify_2 = SimplifyTree(Tree=nurbs_4.Curve, Front=False)  # disabled
panel_42 = Panel("{0;*}")  # disabled
multiplication_6 = Multiplication(A=data_62, B=data_67)  # disabled
offset_l = OffsetCurveLoose(Curve=crv_25, Distance=graft([data_62, neg_5]), Plane=pl_3pt)  # disabled
pt_19 = Point([eval_2.Point, eval.Point])  # disabled
shatter = Shatter(Curve=crv_30, Parameters=data_64)  # -> reverse(Segments); disabled
vec2pt_13 = Vector2Pt(PointA=end_15.Start, PointB=end_15.End, Unitize=False)  # -> Vector, Length; disabled
offset_l_2 = OffsetCurveLoose(Curve=crv_28, Distance=graft([data_62, neg_5]), Plane=xz_3)  # disabled
split_2 = SplitTree(Data=simplify_2, Masks=flatten(panel_42))  # -> flatten(Positive), flatten(Negative); disabled
item_17 = ListItem(List=shatter, Index=0, Wrap=True)  # -> simplify(Item); disabled
offset_l_3 = OffsetCurveLoose(Curve=crv_25, Distance=multiplication_6, Plane=pl_3pt)  # -> simplify(Curve); disabled
data_68 = Data(flip_7.Curve)  # disabled
data_69 = Data(flip_8.Curve)  # disabled
data_70 = Data(crv_24)  # disabled
data_71 = Data(crv_22)  # disabled
offset_l_4 = OffsetCurveLoose(Curve=crv_28, Distance=multiplication_5, Plane=xz_3)  # -> simplify(Curve); disabled
trim_3 = TrimTree(Tree=offset_l, Depth=1)  # disabled
graft_3 = GraftTree(Tree=split_2.Negative, IncludeEmptyLists=True, IncludeNullItems=True)  # disabled
graft_4 = GraftTree(Tree=split_2.Positive, IncludeEmptyLists=True, IncludeNullItems=True)  # disabled
amp_5 = Amplitude(Vector=vec2pt_13.Vector, Amplitude=structure_thickness_4)  # disabled
crv_31 = Curve([data_68, data_69])  # disabled
crv_32 = Curve([data_71, data_70])  # disabled
trim_4 = TrimTree(Tree=offset_l_2, Depth=1)  # disabled
flip_9 = FlipMatrix(Data=offset_l)  # disabled
panel_43 = Panel(item_17)  # disabled
data_72 = Data(division_2)  # disabled
move_21 = Move(Geometry=end_15.Start, Motion=amp_5)  # -> Geometry, Transform; disabled
item_18 = ListItem(List=crv_32, Index=0, Wrap=True)  # -> Item, Item1; disabled
item_19 = ListItem(List=crv_31, Index=0, Wrap=True)  # -> Item, Item1; disabled
number_slider_9 = Slider(0.7, range=0.1..0.9)  # disabled
flip_10 = FlipMatrix(Data=offset_l_2)  # disabled
end_16 = EndPoints(Curve=flip_9)  # -> Start, End; disabled
ln_13 = Line(StartPoint=move_21.Geometry, EndPoint=end_15.End)  # disabled
end_17 = EndPoints(Curve=simplify(ln_13))  # -> Start, End; disabled
pt_20 = Point(end_17.Start)  # disabled
trim_5 = TrimTree(Tree=end_17.Start, Depth=1)  # disabled
flip_11 = FlipMatrix(Data=end_17.Start)  # disabled
crv_33 = Curve(flatten(graft_3))  # disabled
panel_44 = Panel(trim_5)  # disabled
data_73 = Data(item_14.Item1)  # disabled
data_74 = Data(item_13.Item1)  # disabled
data_75 = Data(data_3)  # disabled
end_18 = EndPoints(Curve=flip_10)  # -> Start, End; disabled
item_20 = ListItem(List=flatten(graft_4), Index=0, Wrap=True)  # -> Item, Item1, Item2; disabled
data_76 = Data(data_13)  # disabled
pline_5 = PolyLine(Vertices=end_16.End, Closed=False)  # disabled
pline_6 = PolyLine(Vertices=end_16.Start, Closed=False)  # disabled
panel_45 = Panel("1")  # disabled
end_19 = EndPoints(Curve=crv_31)  # -> Start, End; disabled
end_20 = EndPoints(Curve=crv_32)  # -> Start, End; disabled
crv_34 = Curve(flatten(graft_4))  # disabled
pline_7 = PolyLine(Vertices=flip_11, Closed=False)  # -> simplify(Polyline); disabled
data_77 = Data(data_59)  # disabled
data_78 = Data(pt_19)  # disabled
panel_46 = Panel(ln_13)  # disabled
panel_47 = Panel("2")  # disabled
pt_21 = Point()  # disabled
data_79 = Data(pln_11)  # disabled
item_21 = ListItem(List=crv_33, Index=0, Wrap=True)  # -> Item, Item1; disabled
subtraction_12 = Subtraction(A=panel_45, B=bar_placement_5)  # disabled
pline_8 = PolyLine(Vertices=end_18.Start, Closed=False)  # disabled
pline_9 = PolyLine(Vertices=end_18.End, Closed=False)  # disabled
crv_35 = Curve(simplify(graft([data_73, data_74])))  # disabled
multiplication_7 = Multiplication(A=data_75, B=number_slider_9)  # disabled
xz_4 = XZPlane(Origin=xz)  # disabled
entwine_7 = Entwine(Branch00=end_20.Start, Branch01=end_20.End, FlattenInputs=True)  # disabled
entwine_8 = Entwine(Branch00=end_19.Start, Branch01=end_19.End, FlattenInputs=True)  # disabled
data_80 = Data(data_59)  # disabled
crv_36 = Curve(item_20.Item1)  # disabled
end_21 = EndPoints(Curve=item_21.Item)  # -> Start, End; disabled
end_22 = EndPoints(Curve=item_21.Item1)  # -> Start, End; disabled
division_5 = Division(A=data_75, B=panel_47)  # disabled
data_81 = Data(data_72)  # disabled
panel_48 = Panel("1")  # disabled
panel_49 = Panel("-1")  # disabled
panel_50 = Panel("-1")  # disabled
crv_37 = Curve([pline_7, crv_35])  # disabled
xz_5 = XZPlane(Origin=Point(0, 0, 0))  # disabled
pline_10 = PolyLine(Vertices=entwine_7, Closed=False)  # disabled
pline_11 = PolyLine(Vertices=entwine_8, Closed=False)  # disabled
mirror = Mirror(Geometry=data_78, Plane=xz_4)  # -> Geometry, Transform; disabled
data_82 = Data([panel_49, panel_48, panel_50])  # disabled
eval_3 = EvaluateCurve(Curve=reparameterize(crv_36), Parameter=bar_placement_5)  # -> Point, Tangent, Angle; disabled
eval_4 = EvaluateCurve(Curve=reparameterize(crv_36), Parameter=subtraction_12)  # -> Point, Tangent, Angle; disabled
panel_51 = Panel("0")  # disabled
panel_52 = Panel("1")  # disabled
panel_53 = Panel("1")  # disabled
data_83 = Data(data_8)  # disabled
panel_54 = Panel("-1")  # disabled
data_84 = Data(data_9)  # disabled
data_85 = Data(data_58)  # disabled
panel_55 = Panel("0")  # disabled
neg_6 = Negative(Value=data_81)  # disabled
cp_3 = ControlPoints(Curve=crv_37)  # -> Points, Weights, Knots; disabled
data_86 = Data(multiplication_7)  # disabled
pl_3pt_2 = Plane3Pt(PointA=end_21.Start, PointB=end_21.End, PointC=end_22.End)  # disabled
panel_56 = Panel("1")  # disabled
data_87 = Data(graft([panel_55, panel_53, panel_51]))  # disabled

merge = Merge(Data1=pline_6, Data2=pline_5)  # disabled
item_22 = ListItem(List=merge, Index=data_87, Wrap=True)  # -> flatten(Item); disabled

merge_2 = Merge(Data1=pline_8, Data2=pline_9)  # disabled
item_23 = ListItem(List=merge_2, Index=data_87, Wrap=True)  # -> flatten(Item); disabled

cp_4 = ControlPoints(Curve=item_22)  # -> Points, Weights, Knots; disabled
cp_5 = ControlPoints(Curve=item_23)  # -> Points, Weights, Knots; disabled
avr = Average(Input=cp_4.Points)  # disabled
Y_5 = UnitY(Factor=1)  # disabled
X_7 = UnitX(Factor=1)  # disabled
data_88 = Data([panel_52, panel_54, panel_56])  # disabled
ln_14 = Line(StartPoint=data_78, EndPoint=mirror.Geometry)  # disabled
multiplication_8 = Multiplication(A=data_81, B=data_82)  # disabled
pline_12 = PolyLine(Vertices=cp_3.Points, Closed=False)  # disabled
crv_38 = Curve([pline_11, pline_10])  # disabled
end_23 = EndPoints(Curve=crv_38)  # -> Start, End; disabled
avr_2 = Average(Input=cp_5.Points)  # disabled
pl_origin_3 = PlaneOrigin(Base=data_61, Origin=avr)  # disabled
multiplication_9 = Multiplication(A=data_81, B=data_88)  # disabled
offset_l_5 = OffsetCurveLoose(Curve=crv_33, Distance=graft([data_81, neg_6]), Plane=pl_3pt_2)  # disabled
pt_22 = Point([eval_4.Point, eval_3.Point])  # disabled
shatter_2 = Shatter(Curve=crv_38, Parameters=data_83)  # -> reverse(Segments); disabled
pipe = Pipe(Curve=ln_14, Radius=data_86, Caps=0)  # disabled
trim_6 = TrimTree(Tree=pline_12, Depth=1)  # disabled
vec2pt_14 = Vector2Pt(PointA=end_23.Start, PointB=end_23.End, Unitize=False)  # -> Vector, Length; disabled
cir = Circle(Plane=pl_origin_3, Radius=data_77)  # -> simplify(Circle); disabled
offset_l_6 = OffsetCurveLoose(Curve=crv_34, Distance=graft([data_81, neg_6]), Plane=xz_5)  # disabled
pl = PlaneNormal(Origin=flatten(avr_2), ZAxis=Y_5)  # disabled
flip_12 = FlipMatrix(Data=trim_6)  # disabled
item_24 = ListItem(List=shatter_2, Index=0, Wrap=True)  # -> simplify(Item); disabled
offset_l_7 = OffsetCurveLoose(Curve=crv_33, Distance=multiplication_9, Plane=pl_3pt_2)  # -> simplify(Curve); disabled
cir_2 = Circle(Plane=pl, Radius=data_80)  # -> simplify(Circle); disabled
offset_l_8 = OffsetCurveLoose(Curve=crv_34, Distance=multiplication_8, Plane=xz_5)  # -> simplify(Curve); disabled
trim_7 = TrimTree(Tree=offset_l_5, Depth=1)  # disabled
shatter_3 = Shatter(Curve=flip_12, Parameters=data_65)  # -> reverse(Segments); disabled
amp_6 = Amplitude(Vector=vec2pt_14.Vector, Amplitude=cluster_10)  # disabled
trim_8 = TrimTree(Tree=offset_l_6, Depth=1)  # disabled
flip_13 = FlipMatrix(Data=offset_l_5)  # disabled
panel_57 = Panel(item_24)  # disabled
item_25 = ListItem(List=shatter_3, Index=0, Wrap=True)  # -> simplify(Item); disabled
move_22 = Move(Geometry=end_23.Start, Motion=amp_6)  # -> Geometry, Transform; disabled
number_slider_10 = Slider(0.7, range=0.1..0.9)  # disabled
flip_14 = FlipMatrix(Data=offset_l_6)  # disabled
end_24 = EndPoints(Curve=flip_13)  # -> Start, End; disabled
ln_15 = Line(StartPoint=move_22.Geometry, EndPoint=end_23.End)  # disabled
end_25 = EndPoints(Curve=simplify(ln_15))  # -> Start, End; disabled
pt_23 = Point(end_25.Start)  # disabled
trim_9 = TrimTree(Tree=end_25.Start, Depth=1)  # disabled
flip_15 = FlipMatrix(Data=end_25.Start)  # disabled
panel_58 = Panel(trim_9)  # disabled
data_89 = Data(item_19.Item1)  # disabled
data_90 = Data(item_18.Item1)  # disabled
end_26 = EndPoints(Curve=flip_14)  # -> Start, End; disabled
data_91 = Data(data_10)  # disabled
flip_16 = FlipCurve(Curve=cir)  # -> flatten(Curve), Flag; disabled
pline_13 = PolyLine(Vertices=end_24.End, Closed=False)  # disabled
pline_14 = PolyLine(Vertices=end_24.Start, Closed=False)  # disabled
pline_15 = PolyLine(Vertices=flip_15, Closed=False)  # -> simplify(Polyline); disabled
data_92 = Data(data_72)  # disabled
data_93 = Data(pt_22)  # disabled
panel_59 = Panel(ln_15)  # disabled
panel_60 = Panel("2")  # disabled
end_27 = EndPoints(Curve=item_25)  # -> Start, End; disabled
trim_10 = TrimTree(Tree=item_25, Depth=1)  # disabled
pt_24 = Point()  # disabled
pline_16 = PolyLine(Vertices=end_26.Start, Closed=False)  # disabled
flip_17 = FlipCurve(Curve=cir_2)  # -> flatten(Curve), Flag; disabled
pline_17 = PolyLine(Vertices=end_26.End, Closed=False)  # disabled
multiplication_10 = Multiplication(A=data_91, B=number_slider_10)  # disabled
crv_39 = Curve(simplify(graft([data_89, data_90])))  # disabled
xz_6 = XZPlane(Origin=xz_2)  # disabled
crv_40 = Curve(flatten([item_22, offset_l_3]))  # disabled
data_94 = Data(data_72)  # disabled
trim_11 = TrimTree(Tree=end_27.Start, Depth=1)  # disabled
flip_18 = FlipMatrix(Data=trim_10)  # disabled
division_6 = Division(A=data_91, B=panel_60)  # disabled
crv_41 = Curve([pline_15, crv_39])  # disabled
crv_42 = Curve(flatten([item_23, offset_l_4]))  # disabled
join_7 = JoinCurves(Curves=crv_40, Preserve=False)  # disabled
mirror_2 = Mirror(Geometry=data_93, Plane=xz_6)  # -> Geometry, Transform; disabled
item_26 = ListItem(List=flip_18, Index=0, Wrap=True)  # -> simplify(Item), simplify(Item1); disabled
flip_19 = FlipMatrix(Data=trim_11)  # disabled
panel_61 = Panel("0")  # disabled
panel_62 = Panel("1")  # disabled
panel_63 = Panel("0")  # disabled
cp_6 = ControlPoints(Curve=crv_41)  # -> Points, Weights, Knots; disabled
data_95 = Data(multiplication_10)  # disabled
join_8 = JoinCurves(Curves=crv_42, Preserve=False)  # disabled
data_96 = Data(graft([panel_63, panel_62, panel_61]))  # disabled

merge_3 = Merge(Data1=pline_14, Data2=pline_13)  # disabled
item_27 = ListItem(List=merge_3, Index=data_96, Wrap=True)  # -> flatten(Item); disabled

merge_4 = Merge(Data1=pline_16, Data2=pline_17)  # disabled
item_28 = ListItem(List=merge_4, Index=data_96, Wrap=True)  # -> flatten(Item); disabled

cp_7 = ControlPoints(Curve=item_27)  # -> Points, Weights, Knots; disabled
cp_8 = ControlPoints(Curve=item_28)  # -> Points, Weights, Knots; disabled
avr_3 = Average(Input=cp_7.Points)  # disabled
Y_6 = UnitY(Factor=1)  # disabled
X_8 = UnitX(Factor=1)  # disabled
trim_12 = TrimWithRegion(Curve=flip_16.Curve, Region=join_7)  # -> Inside, Outside; disabled
ln_16 = Line(StartPoint=data_93, EndPoint=mirror_2.Geometry)  # disabled
pline_18 = PolyLine(Vertices=flip_19, Closed=False)  # -> simplify(Polyline); disabled
pline_19 = PolyLine(Vertices=cp_6.Points, Closed=False)  # disabled
avr_4 = Average(Input=cp_8.Points)  # disabled
pl_origin_4 = PlaneOrigin(Base=data_79, Origin=avr_3)  # disabled
trim_13 = TrimWithRegion(Curve=flip_17.Curve, Region=join_8, Plane=xz_3)  # -> Inside, Outside; disabled
pipe_2 = Pipe(Curve=ln_16, Radius=data_95, Caps=0)  # disabled
trim_14 = TrimTree(Tree=pline_19, Depth=1)  # disabled
crv_43 = Curve(flatten([trim_12.Outside, offset_l_3]))  # disabled
cir_3 = Circle(Plane=pl_origin_4, Radius=data_92)  # -> simplify(Circle); disabled
pl_2 = PlaneNormal(Origin=flatten(avr_4), ZAxis=Y_6)  # disabled
crv_44 = Curve([item_26.Item, pline_18])  # disabled
flip_20 = FlipMatrix(Data=trim_14)  # disabled
crv_45 = Curve(flatten([trim_13.Outside, offset_l_4]))  # disabled
graft_5 = GraftTree(Tree=crv_45, IncludeEmptyLists=True, IncludeNullItems=True)  # disabled
graft_6 = GraftTree(Tree=crv_43, IncludeEmptyLists=True, IncludeNullItems=True)  # disabled
join_9 = JoinCurves(Curves=crv_44, Preserve=False)  # disabled
cir_4 = Circle(Plane=pl_2, Radius=data_94)  # -> simplify(Circle); disabled
shatter_4 = Shatter(Curve=flip_20, Parameters=data_84)  # -> reverse(Segments); disabled
loft = Loft(
    Curves=[graft_5, graft_6],
    Options={Adjust=False, Closed=False, LoftEnds=0, LoftSimp=0, LoftType=0, Rebuild=10, Refit=0.01})  # disabled
crv_46 = Curve(flatten(graft_6))  # disabled
data_97 = Data(data_66)  # disabled
item_29 = ListItem(List=shatter_4, Index=0, Wrap=True)  # -> simplify(Item); disabled
explode_5 = Explode(Curve=join_9, Recursive=True)  # -> Segments, Vertices; disabled
join_10 = BrepJoin(Breps=flatten(loft))  # -> Breps, Closed; disabled
divide_3 = DivideCurve(Curve=explode_5.Segments, Count=data_97, Kinks=False)  # -> Points, Tangents, Parameters; disabled
cap = CapHoles(Brep=join_10.Breps)  # disabled
flip_21 = FlipCurve(Curve=cir_3)  # -> flatten(Curve), Flag; disabled
trim_15 = TrimTree(Tree=divide_3.Points, Depth=1)  # disabled
end_28 = EndPoints(Curve=item_29)  # -> Start, End; disabled
trim_16 = TrimTree(Tree=item_29, Depth=1)  # disabled
flip_22 = FlipCurve(Curve=cir_4)  # -> flatten(Curve), Flag; disabled
crv_47 = Curve(flatten([item_27, offset_l_7]))  # disabled

pline_20 = PolyLine(Vertices=trim_15, Closed=False)  # disabled
cp_9 = ControlPoints(Curve=pline_20)  # -> Points, Weights, Knots; disabled

trim_17 = TrimTree(Tree=end_28.Start, Depth=1)  # disabled
flip_23 = FlipMatrix(Data=trim_16)  # disabled
brep_3 = Brep(cap)  # disabled
crv_48 = Curve(flatten([item_28, offset_l_8]))  # disabled
join_11 = JoinCurves(Curves=crv_47, Preserve=False)  # disabled
nurbs_5 = NurbsCurve(Vertices=cp_9.Points, Degree=3, Periodic=False)  # -> Curve, Length, Domain; disabled
item_30 = ListItem(List=flip_23, Index=0, Wrap=True)  # -> simplify(Item), simplify(Item1); disabled
flip_24 = FlipMatrix(Data=trim_17)  # disabled
join_12 = JoinCurves(Curves=crv_48, Preserve=False)  # disabled
len_7 = Length(Curve=nurbs_5.Curve)  # disabled
trim_18 = TrimWithRegion(Curve=flip_21.Curve, Region=join_11)  # -> Inside, Outside; disabled
pline_21 = PolyLine(Vertices=flip_24, Closed=False)  # -> simplify(Polyline); disabled
division_7 = Division(A=len_7, B=2)  # disabled
trim_19 = TrimWithRegion(Curve=flip_22.Curve, Region=join_12, Plane=xz_5)  # -> Inside, Outside; disabled
crv_49 = Curve(flatten([trim_18.Outside, offset_l_7]))  # disabled
ext_5 = ExtendCurve(Curve=nurbs_5.Curve, Type=2, Start=division_7, End=division_7)  # -> flatten(Curve); disabled
crv_50 = Curve([item_30.Item, pline_21])  # disabled
crv_51 = Curve()  # disabled
crv_52 = Curve(flatten([trim_19.Outside, offset_l_8]))  # disabled
graft_7 = GraftTree(Tree=crv_52, IncludeEmptyLists=True, IncludeNullItems=True)  # disabled
graft_8 = GraftTree(Tree=crv_49, IncludeEmptyLists=True, IncludeNullItems=True)  # disabled
join_13 = JoinCurves(Curves=crv_50, Preserve=False)  # disabled
loft_2 = Loft(
    Curves=[graft_7, graft_8],
    Options={Adjust=False, Closed=False, LoftEnds=0, LoftSimp=0, LoftType=0, Rebuild=10, Refit=0.01})  # disabled
crv_53 = Curve(flatten(graft_8))  # disabled
end_29 = EndPoints(Curve=ext_5)  # -> Start, End; disabled
data_98 = Data(ext_5)  # disabled
data_99 = Data(data_85)  # disabled
explode_6 = Explode(Curve=join_13, Recursive=True)  # -> Segments, Vertices; disabled
join_14 = BrepJoin(Breps=flatten(loft_2))  # -> Breps, Closed; disabled
ln_17 = Line(StartPoint=end_29.Start, EndPoint=end_29.End)  # disabled
divide_4 = DivideCurve(Curve=explode_6.Segments, Count=data_99, Kinks=False)  # -> Points, Tangents, Parameters; disabled
panel_64 = Panel("34")  # disabled
join_15 = JoinCurves(Curves=[ln_17, data_98], Preserve=False)  # disabled
cap_2 = CapHoles(Brep=join_14.Breps)  # disabled
trim_20 = TrimTree(Tree=divide_4.Points, Depth=1)  # disabled
boundary = BoundarySurfaces(Edges=join_15)  # disabled
neg_7 = Negative(Value=panel_64)  # disabled

pline_22 = PolyLine(Vertices=trim_20, Closed=False)  # disabled
cp_10 = ControlPoints(Curve=pline_22)  # -> Points, Weights, Knots; disabled

brep_4 = Brep(cap_2)  # disabled
offset = OffsetSurface(Surface=graft(boundary), Distance=[panel_64, neg_7], Retrim=True)  # disabled
geo_3 = Geometry(brep_3)  # disabled
nurbs_6 = NurbsCurve(Vertices=cp_10.Points, Degree=3, Periodic=False)  # -> Curve, Length, Domain; disabled
len_8 = Length(Curve=nurbs_6.Curve)  # disabled
loft_3 = Loft(Curves=offset, Options={Adjust=False, Closed=False, LoftEnds=0, LoftSimp=0, LoftType=0, Rebuild=10, Refit=0.01})  # disabled
dispatch = Dispatch(List=flatten(loft_3), DispatchPattern=[True, False])  # -> ListA, ListB; disabled
geo_4 = Geometry(loft_3)  # disabled
division_8 = Division(A=len_8, B=2)  # disabled
cap_3 = CapHoles(Brep=geo_4)  # disabled
sdiff = SolidDifference(BrepsA=flatten(brep_3), BrepsB=flatten(cap_3))  # disabled
ext_6 = ExtendCurve(Curve=nurbs_6.Curve, Type=2, Start=len_8, End=len_8)  # -> flatten(Curve); disabled
crv_54 = Curve()  # disabled
end_30 = EndPoints(Curve=ext_6)  # -> Start, End; disabled
data_100 = Data(ext_6)  # disabled
multiplication_11 = Multiplication(A=cluster_10, B=2)  # disabled
brep_5 = Brep(sdiff)  # disabled
ln_18 = Line(StartPoint=end_30.Start, EndPoint=end_30.End)  # disabled
panel_65 = Panel("34")  # disabled
bbox = BoundingBox(Content=brep_5, Plane=PlaneXY(0, 0, 0))  # -> Box, Box_2; disabled
join_16 = JoinCurves(Curves=[ln_18, data_100], Preserve=False)  # disabled
crv_55 = Curve(crv_46)  # disabled
volume = Volume(Geometry=bbox.Box)  # -> Volume, Centroid; disabled
boundary_2 = BoundarySurfaces(Edges=join_16)  # disabled
neg_8 = Negative(Value=multiplication_11)  # disabled
mirror_3 = Mirror(Geometry=crv_55, Plane=data_60)  # -> Geometry, Transform; disabled
sort = SortList(Keys=volume.Volume, ValuesA=brep_5)  # -> Keys, reverse(ValuesA); disabled
offset_2 = OffsetSurface(Surface=graft(boundary_2), Distance=[multiplication_11, neg_8], Retrim=True)  # disabled
geo_5 = Geometry(brep_4)  # disabled
item_31 = ListItem(List=sort.ValuesA, Index=0, Wrap=True)  # disabled
geo_6 = Geometry(flatten(item_31))  # disabled
mirror_4 = Mirror(Geometry=geo_6, Plane=data_60)  # -> Geometry, Transform; disabled
crv_56 = Curve([crv_55, mirror_3.Geometry])  # disabled
number_slider_11 = Slider(1, range=0..1)  # disabled
loft_4 = Loft(Curves=offset_2, Options={Adjust=False, Closed=False, LoftEnds=0, LoftSimp=0, LoftType=0, Rebuild=10, Refit=0.01})  # disabled
dispatch_2 = Dispatch(List=flatten(loft_4), DispatchPattern=[True, False])  # -> ListA, ListB; disabled
geo_7 = Geometry(loft_4)  # disabled
cap_4 = CapHoles(Brep=geo_7)  # disabled
sdiff_2 = SolidDifference(BrepsA=flatten(brep_4), BrepsB=flatten(cap_4))  # disabled
gradient = Gradient(LowerLimit=0, UpperLimit=1, Parameter=number_slider_11, stops=[0: RGB(255, 0, 106), 1: RGB(255, 123, 0)])  # disabled
data_101 = Data(mirror_4.Geometry)  # disabled
data_102 = Data(geo_6)  # disabled
relay = Relay([data_102, data_101])  # disabled
swatch = ColourSwatch(SwatchColor=RGB(255, 0, 106))  # disabled
swatch_2 = ColourSwatch(SwatchColor=RGB(255, 123, 0))  # disabled
swatch_3 = ColourSwatch(SwatchColor=RGB(255, 204, 0))  # disabled
brep_6 = Brep(sdiff_2)  # disabled
swatch_4 = ColourSwatch(SwatchColor=RGB(0, 0, 0))  # disabled
swatch_5 = ColourSwatch(SwatchColor=RGB(255, 222, 138))  # disabled
data_103 = Data(pipe)  # disabled
swatch_6 = ColourSwatch(SwatchColor=RGB(255, 99, 99))  # disabled
bbox_2 = BoundingBox(Content=brep_6, Plane=PlaneXY(0, 0, 0))  # -> Box, Box_2; disabled
swatch_7 = ColourSwatch(SwatchColor=RGB(0, 0, 0))  # disabled
crv_57 = Curve(crv_53)  # disabled
volume_2 = Volume(Geometry=bbox_2.Box)  # -> Volume, Centroid; disabled
mesh_5 = MeshBrep(
    Brep=relay,
    Settings={GridMaxCount=0, GridMinCount=16, JaggedSeams=False, MaxEdgeLength=0, MinEdgeLength=0.0001, MinTolerance=0, Refine=True, RefineAngle=0, RelativeTolerance=0.65, SimplePlanes=True, Tolerance=0})  # disabled
mesh_6 = Mesh(data_103)  # disabled
material = CreateMaterial(Diffuse=gradient, Specular=RGB(255, 255, 255), Emission=RGB(0, 0, 0), Transparency=0, Shine=0)  # disabled
mirror_5 = Mirror(Geometry=crv_57, Plane=data_76)  # -> Geometry, Transform; disabled
swatch_8 = ColourSwatch(SwatchColor=RGB(0, 0, 0))  # disabled
sort_2 = SortList(Keys=volume_2.Volume, ValuesA=brep_6)  # -> Keys, reverse(ValuesA); disabled
preview_7 = CustomPreview(Geometry=mesh_6, Material=swatch_7)  # disabled
preview_8 = CustomPreview(Geometry=mesh_5, Material=material)  # disabled
item_32 = ListItem(List=sort_2.ValuesA, Index=0, Wrap=True)  # disabled
geo_8 = Geometry(flatten(item_32))  # disabled
mirror_6 = Mirror(Geometry=geo_8, Plane=data_76)  # -> Geometry, Transform; disabled
preview_9 = CustomPreview(Geometry=crv_56, Material=swatch_8)  # disabled
crv_58 = Curve([crv_57, mirror_5.Geometry])  # disabled
number_slider_12 = Slider(1, range=0..1)  # disabled
gradient_2 = Gradient(LowerLimit=0, UpperLimit=1, Parameter=number_slider_12, stops=[0: RGB(255, 0, 106), 1: RGB(255, 123, 0)])  # disabled
data_104 = Data(geo_8)  # disabled
data_105 = Data(mirror_6.Geometry)  # disabled
relay_2 = Relay([data_104, data_105])  # disabled
swatch_9 = ColourSwatch(SwatchColor=RGB(255, 0, 106))  # disabled
swatch_10 = ColourSwatch(SwatchColor=RGB(255, 123, 0))  # disabled
swatch_11 = ColourSwatch(SwatchColor=RGB(255, 204, 0))  # disabled
swatch_12 = ColourSwatch(SwatchColor=RGB(0, 0, 0))  # disabled
swatch_13 = ColourSwatch(SwatchColor=RGB(255, 222, 138))  # disabled
data_106 = Data(pipe_2)  # disabled
swatch_14 = ColourSwatch(SwatchColor=RGB(255, 99, 99))  # disabled
swatch_15 = ColourSwatch(SwatchColor=RGB(0, 0, 0))  # disabled
mesh_7 = MeshBrep(
    Brep=relay_2,
    Settings={GridMaxCount=0, GridMinCount=16, JaggedSeams=False, MaxEdgeLength=0, MinEdgeLength=0.0001, MinTolerance=0, Refine=True, RefineAngle=0, RelativeTolerance=0.65, SimplePlanes=True, Tolerance=0})  # disabled
mesh_8 = Mesh(data_106)  # disabled
material_2 = CreateMaterial(Diffuse=gradient_2, Specular=RGB(255, 255, 255), Emission=RGB(0, 0, 0), Transparency=0, Shine=0)  # disabled
swatch_16 = ColourSwatch(SwatchColor=RGB(0, 0, 0))  # disabled
preview_10 = CustomPreview(Geometry=mesh_8, Material=swatch_15)  # disabled
preview_11 = CustomPreview(Geometry=mesh_7, Material=material_2)  # disabled
preview_12 = CustomPreview(Geometry=crv_58, Material=swatch_16)  # disabled

# ==== cluster Cluster
crv = ClusterInput()
crv_2 = ClusterInput()
crv_3 = Curve(flatten(crv))
crv_4 = Curve(flatten(crv_2))
cp = ControlPoints(Curve=graft(crv_3))  # -> Points, Weights, Knots
cp_2 = ControlPoints(Curve=graft(crv_4))  # -> Points, Weights, Knots
ln = Line(StartPoint=cp_2.Points, EndPoint=cp.Points)
len = Length(Curve=ln)
ext = ExtendCurve(Curve=ln, Type=0, Start=len, End=len)
loft = Loft(Curves=ext, Options={Adjust=False, Closed=False, LoftEnds=0, LoftSimp=0, LoftType=0, Rebuild=10, Refit=0.01})
L = ClusterOutput(loft)

# ==== cluster Cluster_2
A = ClusterInput()
B = ClusterInput()
graph = ClusterInput()
dom = ConstructDomain(DomainStart=A, DomainEnd=B)
graph_2 = GraphMapper(
    graph,
    x0=0,
    x1=1,
    y0=0,
    y1=1,
    container_name="Bezier",
    cpx=[0, 0.459231168, 0.5282088518, 1],
    cpy=[0, 0.03727918863, 0.8716881871, 1])
remap = RemapNumbers(Value=graph_2, Source=Domain(0, 1), Target=dom)  # -> Mapped, Clipped
round = Round(Number=remap.Mapped)  # -> Nearest, Floor, Ceiling
N = ClusterOutput(round.Nearest)

# ==== cluster Cluster_3
A = ClusterInput()
F = ClusterInput()
pt = ClusterInput()
pt_2 = ClusterInput()
relay = ClusterInput()
relay_2 = ClusterInput()
relay_3 = ClusterInput()
relay_4 = ClusterInput()
relay_5 = ClusterInput()
relay_6 = ClusterInput()
relay_7 = ClusterInput()
relay_8 = ClusterInput()
relay_9 = ClusterInput()
relay_10 = ClusterInput()
D = ClusterInput()
addition = Addition(A=A, B=2)
Y = UnitY(Factor=F)
pt_3 = Point(pt_2)
rad = Radians(Degrees=relay_6)
pt_4 = Point(pt)
division = Division(A=relay_10, B=100)
multiplication = Multiplication(A=relay_9, B=0.01)
division_2 = Division(A=multiplication, B=10)
addition_2 = Addition(A=relay_3, B=relay_4)
Z = UnitZ(Factor=relay)
Z_2 = UnitZ(Factor=relay_2)
X = UnitX(Factor=relay_3)
X_2 = UnitX(Factor=relay_3)
X_3 = UnitX(Factor=addition_2)
pi = Pi(Factor="-0.25")
pi_2 = Pi(Factor="-0.75")
pi_3 = Pi(Factor="-0.25")
xy = XYPlane(Origin=pt_3)
division_3 = Division(A=relay_7, B=2)
Z_3 = UnitZ(Factor=division_3)
move = Move(Geometry=pt_3, Motion=Z_3)  # -> Geometry, Transform
subtraction = Subtraction(A=Z, B=Z_3)
move_2 = Move(Geometry=move.Geometry, Motion=X)  # -> Geometry, Transform
move_3 = Move(Geometry=move.Geometry, Motion=X_2)  # -> Geometry, Transform
move_4 = Move(Geometry=move.Geometry, Motion=X_3)  # -> Geometry, Transform
addition_3 = Addition(A=Z_2, B=subtraction, C=Y)
rotate = Rotate(Geometry=move_2.Geometry, Angle=pi, Plane=move.Geometry)  # -> Geometry, Transform
rotate_2 = Rotate(Geometry=move_3.Geometry, Angle=pi_2, Plane=move.Geometry)  # -> Geometry, Transform
rotate_3 = Rotate(Geometry=move_4.Geometry, Angle=pi_3, Plane=move.Geometry)  # -> Geometry, Transform
pt_5 = Point(rotate_2.Geometry)
pt_6 = Point(rotate_3.Geometry)
yz = YZPlane(Origin=rotate.Geometry)
move_5 = Move(Geometry=rotate_2.Geometry, Motion=addition_3)  # -> Geometry, Transform
pt_7 = Point(move_5.Geometry)
srf4pt = _4PointSurface(CornerA=pt_6, CornerB=pt_5, CornerC=pt_7)
ln = Line(StartPoint=pt_6, EndPoint=pt_5)
move_6 = Move(Geometry=xy, Motion=subtraction)  # -> Geometry, Transform
sec = BrepPlane(Brep=srf4pt, Plane=move_6.Geometry)  # -> Curves, Points
plx = LinePlane(Line=sec.Curves, Plane=yz)  # -> Point, ParamL, ParamP
end = EndPoints(Curve=sec.Curves)  # -> Start, End
dist = Distance(PointA=plx.Point, PointB=end.End)
min = Minimum(A=relay_5, B=dist)
data = Data(division_2)
data_2 = Data(division_3)
xz = XZPlane(Origin=pt_3)
vec2pt = Vector2Pt(PointA=plx.Point, PointB=end.End, Unitize=False)  # -> Vector, Length
amp = Amplitude(Vector=vec2pt.Vector, Amplitude=min)
pi_4 = Pi(Factor=rad)
move_7 = Move(Geometry=plx.Point, Motion=amp)  # -> Geometry, Transform
pln = Plane(srf4pt)
neg = Negative(Value=pi_4)
vec = Vector(pln)
ln_2 = Line(StartPoint=plx.Point, EndPoint=move_7.Geometry)
crv = Curve(ln_2)
end_2 = EndPoints(Curve=crv)  # -> Start, End
rot3d = Rotate3D(Geometry=ln_2, Angle=neg, Center=end_2.End, Axis=vec)  # -> Geometry, Transform
data_3 = Data(relay_8)
data_4 = Data(relay_8)
data_5 = Data(xz)
neg_2 = Negative(Value=data_3)
data_6 = Data(srf4pt)
xy_2 = XYPlane(Origin=move.Geometry)
line = Line(rot3d.Geometry)
data_7 = Data(pt_5)
flip = FlipCurve(Curve=line)  # -> Curve, Flag
end_3 = EndPoints(Curve=flip.Curve)  # -> Start, End
data_8 = Data(pt_6)
data_9 = Data(end_3.Start)
data_10 = Data(pt_7)
data_11 = Data(end_3.End)
vec2pt_2 = Vector2Pt(PointA=data_11, PointB=data_8, Unitize=False)  # -> Vector, Length
data_12 = Data(vec)
vec2pt_3 = Vector2Pt(PointA=end_3.Start, PointB=data_7, Unitize=False)  # -> Vector, Length
projecta = ProjectAlong(Geometry=data_8, Plane=xy_2, Direction=vec2pt_2.Vector)  # -> Geometry, Transform
projecta_2 = ProjectAlong(Geometry=data_7, Plane=xy_2, Direction=vec2pt_3.Vector)  # -> Geometry, Transform
ln_3 = Line(StartPoint=data_11, EndPoint=projecta.Geometry)
ln_4 = Line(StartPoint=data_9, EndPoint=data_10)
ln_5 = Line(StartPoint=end_3.Start, EndPoint=projecta_2.Geometry)
pt_8 = Point(data_10)
crv_2 = Curve(graft([ln_4, ln_5, ln_3]))
data_13 = Data(xz)
Y_2 = UnitY(Factor=neg_2)
curvepoint = PointOnCurve(crv_2, parameter=0.667)
end_4 = EndPoints(Curve=crv_2)  # -> Start, End
data_14 = Data(crv_2)
vec_2 = Vector(data_12)
data_15 = Data(flip.Curve)
pt_9 = Point(end_4.Start)
move_8 = Move(Geometry=data_13, Motion=Y_2)  # -> Geometry, Transform
pt_10 = Point(end_4.End)
data_16 = Data(move_8.Geometry)
data_17 = Data(pt_9)
projecta_3 = ProjectAlong(Geometry=data_15, Plane=data_16, Direction=vec_2)  # -> Geometry, Transform
project = Project(Geometry=curvepoint, Plane=data_16)  # -> Geometry, Transform
projecta_4 = ProjectAlong(Geometry=data_17, Plane=data_16, Direction=vec_2)  # -> Geometry, Transform
geo = Geometry(srf4pt)
pl_origin = PlaneOrigin(Base=xy_2, Origin=pt_10)
vec2pt_4 = Vector2Pt(PointA=projecta_4.Geometry, PointB=project.Geometry, Unitize=False)  # -> Vector, Length
data_18 = Data(data_14)
projecta_5 = ProjectAlong(Geometry=project.Geometry, Plane=pl_origin, Direction=vec2pt_4.Vector)  # -> Geometry, Transform
ln_6 = Line(StartPoint=projecta_4.Geometry, EndPoint=projecta_5.Geometry)
pln_2 = Plane(geo)
item = ListItem(List=flatten(projecta_4.Geometry), Index=0, Wrap=True)
item_2 = ListItem(List=flatten(projecta_5.Geometry), Index=0, Wrap=True)
item_3 = ListItem(List=flatten(projecta_5.Geometry), Index="1", Wrap=True)
data_19 = Data(projecta_3.Geometry)
cluster = Cluster(crv_2=data_15, crv=projecta_3.Geometry)
cluster_2 = Cluster(crv_2=data_18, crv=ln_6)  # -> flatten(L)
data_20 = Data(data_16)
pln_3 = Plane(geo)
pull = PullPoint(Point=item_2, Geometry=pln_2, ClosestOnly=True)  # -> ClosestPoint, Distance
pull_2 = PullPoint(Point=item_3, Geometry=pln_3, ClosestOnly=True)  # -> ClosestPoint, Distance
srf = Surface(flatten([cluster_2, cluster]))
subtraction_2 = Subtraction(A=pull_2.Distance, B=pull.Distance)
item_4 = ListItem(List=srf, Index=0, Wrap=True)  # -> Item, Item1, Item2, Item3
vec2pt_5 = Vector2Pt(PointA=item_3, PointB=pull_2.ClosestPoint, Unitize=False)  # -> Vector, Length
data_21 = Data(item_2)
data_22 = Data(item)
data_23 = Data(item_3)
amp_2 = Amplitude(Vector=vec2pt_5.Vector, Amplitude=subtraction_2)
join = BrepJoin(Breps=[item_4.Item1, item_4.Item2, item_4.Item3])  # -> Breps, Closed
join_2 = BrepJoin(Breps=[item_4.Item, item_4.Item1])  # -> Breps, Closed
join_3 = BrepJoin(Breps=[item_4.Item, item_4.Item3, item_4.Item2])  # -> Breps, Closed
line_2 = Line(data_19)
move_9 = Move(Geometry=item_3, Motion=amp_2)  # -> Geometry, Transform
pln_4 = Plane(data_6)
pln_5 = Plane(data_20)
pln_6 = Plane(pln_5)
pln_7 = Plane(pln_4)
nurbs = NurbsCurve(Vertices=[data_21, data_22, move_9.Geometry], Degree="2", Periodic=False)  # -> Curve, Length, Domain
len = Length(Curve=line_2)
data_24 = Data(line_2)
data_25 = Data([join_2.Breps, join.Breps, join_3.Breps])
ext = ExtendCurve(Curve=data_24, Type=0, Start=len, End=len)
len_2 = Length(Curve=nurbs.Curve)

sec_2 = BrepPlane(Brep=data_25, Plane=pln_6)  # -> graft(Curves), Points
sec_3 = BrepPlane(Brep=data_25, Plane=pln_7)  # -> graft(Curves), Points

ext_2 = ExtendCurve(Curve=nurbs.Curve, Type=0, Start=len_2, End=len_2)
end_5 = EndPoints(Curve=ext)  # -> Start, End
vec2pt_6 = Vector2Pt(PointA=end_5.Start, PointB=end_5.End, Unitize=False)  # -> Vector, Length
flip_2 = FlipCurve(Curve=sec_3.Curves)  # -> Curve, Flag
rev = Reverse(Vector=vec2pt_6.Vector)
vec_3 = Vector(vec2pt_6.Vector)
explode = Explode(Curve=sec_2.Curves, Recursive=True)  # -> Segments, Vertices
explode_2 = Explode(Curve=flip_2.Curve, Recursive=True)  # -> Segments, Vertices
extr = Extrude(Base=ext_2, Direction=vec_3)
multiplication_2 = Multiplication(A=rev, B="0.3")
move_10 = Move(Geometry=extr, Motion=multiplication_2)  # -> Geometry, Transform
entwine = Entwine(Branch0X=explode.Segments, Branch1X=explode_2.Segments, FlattenInputs=False)
crv_3 = Curve(flatten(explode_2.Segments))
crv_4 = Curve(flatten(explode.Segments))
panel = Panel("2")
crv_5 = Curve(entwine)
item_5 = ListItem(List=crv_3, Index=0, Wrap=True)  # -> Item, Item1, Item2, Item3, Item4
item_6 = ListItem(List=crv_4, Index=0, Wrap=True)  # -> Item, Item1, Item2, Item3, Item4
len_3 = Length(Curve=crv_5)
subtraction_3 = Subtraction(A=addition, B=1)
data_26 = Data(subtraction_3)
crv_6 = Curve(item_5.Item2)
crv_7 = Curve(item_5.Item4)
crv_8 = Curve(item_6.Item2)
crv_9 = Curve(item_6.Item4)
division_4 = Division(A=len_3, B=Slider(200, range=50..200))
flip_3 = FlipCurve(Curve=crv_6)  # -> Curve, Flag
flip_4 = FlipCurve(Curve=crv_8)  # -> Curve, Flag
round = Round(Number=division_4)  # -> Nearest, Floor, Ceiling
max = Maximum(A=round.Nearest, B="2")
crv_10 = Curve(item_5.Item1)
crv_11 = Curve(item_6.Item1)
divide = DivideCurve(Curve=crv_5, Count=addition, Kinks=False)  # -> Points, Tangents, Parameters
trim = TrimTree(Tree=divide.Points, Depth=1)

pline = PolyLine(Vertices=trim, Closed=False)
cp = ControlPoints(Curve=pline)  # -> Points, Weights, Knots

nurbs_2 = NurbsCurve(Vertices=cp.Points, Degree=3, Periodic=False)  # -> Curve, Length, Domain
simplify = SimplifyTree(Tree=nurbs_2.Curve, Front=False)
split = SplitTree(Data=simplify, Masks=flatten("{0;*}"))  # -> flatten(Positive), flatten(Negative)
data_27 = Data(flip_3.Curve)
data_28 = Data(flip_4.Curve)
data_29 = Data(crv_9)
data_30 = Data(crv_7)
graft = GraftTree(Tree=split.Negative, IncludeEmptyLists=True, IncludeNullItems=True)
graft_2 = GraftTree(Tree=split.Positive, IncludeEmptyLists=True, IncludeNullItems=True)
crv_12 = Curve([data_27, data_28])
crv_13 = Curve([data_30, data_29])
data_31 = Data(division_3)
item_7 = ListItem(List=crv_13, Index=0, Wrap=True)  # -> Item, Item1
item_8 = ListItem(List=crv_12, Index=0, Wrap=True)  # -> Item, Item1
crv_14 = Curve(flatten(graft))
item_9 = ListItem(List=flatten(graft_2), Index=0, Wrap=True)  # -> Item, Item1, Item2
data_32 = Data(data_5)
end_6 = EndPoints(Curve=crv_12)  # -> Start, End
end_7 = EndPoints(Curve=crv_13)  # -> Start, End
crv_15 = Curve(flatten(graft_2))
data_33 = Data(pln_4)
item_10 = ListItem(List=crv_14, Index=0, Wrap=True)  # -> Item, Item1
subtraction_4 = Subtraction(A="1", B=division)
entwine_2 = Entwine(Branch00=end_7.Start, Branch01=end_7.End, FlattenInputs=True)
entwine_3 = Entwine(Branch00=end_6.Start, Branch01=end_6.End, FlattenInputs=True)
crv_16 = Curve(item_9.Item1)
end_8 = EndPoints(Curve=item_10.Item)  # -> Start, End
end_9 = EndPoints(Curve=item_10.Item1)  # -> Start, End
data_34 = Data(data_31)
xz_2 = XZPlane(Origin=pt_3)
pline_2 = PolyLine(Vertices=entwine_2, Closed=False)
pline_3 = PolyLine(Vertices=entwine_3, Closed=False)
data_35 = Data(["-1", "1", "-1"])
eval = EvaluateCurve(Curve=reparameterize(crv_16), Parameter=division)  # -> Point, Tangent, Angle
eval_2 = EvaluateCurve(Curve=reparameterize(crv_16), Parameter=subtraction_4)  # -> Point, Tangent, Angle
data_36 = Data(data)
data_37 = Data(data_26)
neg_3 = Negative(Value=data_34)
pl_3pt = Plane3Pt(PointA=end_8.Start, PointB=end_8.End, PointC=end_9.End)
data_38 = Data(["1", "-1", "1"])
multiplication_3 = Multiplication(A=data_34, B=data_35)
crv_17 = Curve([pline_3, pline_2])
end_10 = EndPoints(Curve=crv_17)  # -> Start, End
multiplication_4 = Multiplication(A=data_34, B=data_38)
offset_l = OffsetCurveLoose(Curve=crv_14, Distance=graft([data_34, neg_3]), Plane=pl_3pt)
pt_11 = Point([eval_2.Point, eval.Point])
vec2pt_7 = Vector2Pt(PointA=end_10.Start, PointB=end_10.End, Unitize=False)  # -> Vector, Length
offset_l_2 = OffsetCurveLoose(Curve=crv_15, Distance=graft([data_34, neg_3]), Plane=xz_2)
offset_l_3 = OffsetCurveLoose(Curve=crv_14, Distance=multiplication_4, Plane=pl_3pt)  # -> simplify(Curve)
offset_l_4 = OffsetCurveLoose(Curve=crv_15, Distance=multiplication_3, Plane=xz_2)  # -> simplify(Curve)
trim_2 = TrimTree(Tree=offset_l, Depth=1)
amp_3 = Amplitude(Vector=vec2pt_7.Vector, Amplitude=relay_7)
trim_3 = TrimTree(Tree=offset_l_2, Depth=1)
flip_5 = FlipMatrix(Data=offset_l)
move_11 = Move(Geometry=end_10.Start, Motion=amp_3)  # -> Geometry, Transform
flip_6 = FlipMatrix(Data=offset_l_2)
end_11 = EndPoints(Curve=flip_5)  # -> Start, End
ln_7 = Line(StartPoint=move_11.Geometry, EndPoint=end_10.End)
end_12 = EndPoints(Curve=simplify(ln_7))  # -> Start, End
pt_12 = Point(end_12.Start)
trim_4 = TrimTree(Tree=end_12.Start, Depth=1)
flip_7 = FlipMatrix(Data=end_12.Start)
panel_2 = Panel(trim_4)
data_39 = Data(item_8.Item1)
data_40 = Data(item_7.Item1)
end_13 = EndPoints(Curve=flip_6)  # -> Start, End
data_41 = Data(data_2)
pline_4 = PolyLine(Vertices=end_11.End, Closed=False)
pline_5 = PolyLine(Vertices=end_11.Start, Closed=False)
pline_6 = PolyLine(Vertices=flip_7, Closed=False)  # -> simplify(Polyline)
data_42 = Data(data_31)
data_43 = Data(pt_11)
panel_3 = Panel(ln_7)
pt_13 = Point()
pline_7 = PolyLine(Vertices=end_13.Start, Closed=False)
pline_8 = PolyLine(Vertices=end_13.End, Closed=False)
multiplication_5 = Multiplication(A=data_41, B=Slider(0.7, range=0.1..0.9))
crv_18 = Curve(simplify(graft([data_39, data_40])))
xz_3 = XZPlane(Origin=xz)
data_44 = Data(data_31)
division_5 = Division(A=data_41, B="2")
crv_19 = Curve([pline_6, crv_18])
mirror = Mirror(Geometry=data_43, Plane=xz_3)  # -> Geometry, Transform
cp_2 = ControlPoints(Curve=crv_19)  # -> Points, Weights, Knots
data_45 = Data(multiplication_5)
data_46 = Data(graft(["0", "1", "0"]))

merge = Merge(Data1=pline_5, Data2=pline_4)
item_11 = ListItem(List=merge, Index=data_46, Wrap=True)  # -> flatten(Item)

merge_2 = Merge(Data1=pline_7, Data2=pline_8)
item_12 = ListItem(List=merge_2, Index=data_46, Wrap=True)  # -> flatten(Item)

cp_3 = ControlPoints(Curve=item_11)  # -> Points, Weights, Knots
cp_4 = ControlPoints(Curve=item_12)  # -> Points, Weights, Knots
avr = Average(Input=cp_3.Points)
Y_3 = UnitY(Factor=1)
X_4 = UnitX(Factor=1)
ln_8 = Line(StartPoint=data_43, EndPoint=mirror.Geometry)
pline_9 = PolyLine(Vertices=cp_2.Points, Closed=False)
avr_2 = Average(Input=cp_4.Points)
pl_origin_2 = PlaneOrigin(Base=data_33, Origin=avr)
pipe = Pipe(Curve=ln_8, Radius=data_45, Caps=0)
trim_5 = TrimTree(Tree=pline_9, Depth=1)
cir = Circle(Plane=pl_origin_2, Radius=data_42)  # -> simplify(Circle)
pl = PlaneNormal(Origin=flatten(avr_2), ZAxis=Y_3)
flip_8 = FlipMatrix(Data=trim_5)
cir_2 = Circle(Plane=pl, Radius=data_44)  # -> simplify(Circle)
shatter = Shatter(Curve=flip_8, Parameters=data_36)  # -> reverse(Segments)
item_13 = ListItem(List=shatter, Index=0, Wrap=True)  # -> simplify(Item)
flip_9 = FlipCurve(Curve=cir)  # -> flatten(Curve), Flag
end_14 = EndPoints(Curve=item_13)  # -> Start, End
trim_6 = TrimTree(Tree=item_13, Depth=1)
flip_10 = FlipCurve(Curve=cir_2)  # -> flatten(Curve), Flag
crv_20 = Curve(flatten([item_11, offset_l_3]))
trim_7 = TrimTree(Tree=end_14.Start, Depth=1)
flip_11 = FlipMatrix(Data=trim_6)
crv_21 = Curve(flatten([item_12, offset_l_4]))
join_4 = JoinCurves(Curves=crv_20, Preserve=False)
item_14 = ListItem(List=flip_11, Index=0, Wrap=True)  # -> simplify(Item), simplify(Item1)
flip_12 = FlipMatrix(Data=trim_7)
join_5 = JoinCurves(Curves=crv_21, Preserve=False)
trim_8 = TrimWithRegion(Curve=flip_9.Curve, Region=join_4)  # -> Inside, Outside
pline_10 = PolyLine(Vertices=flip_12, Closed=False)  # -> simplify(Polyline)
trim_9 = TrimWithRegion(Curve=flip_10.Curve, Region=join_5, Plane=xz_2)  # -> Inside, Outside
crv_22 = Curve(flatten([trim_8.Outside, offset_l_3]))
crv_23 = Curve([item_14.Item, pline_10])
crv_24 = Curve(flatten([trim_9.Outside, offset_l_4]))
graft_3 = GraftTree(Tree=crv_24, IncludeEmptyLists=True, IncludeNullItems=True)
graft_4 = GraftTree(Tree=crv_22, IncludeEmptyLists=True, IncludeNullItems=True)
join_6 = JoinCurves(Curves=crv_23, Preserve=False)
loft = Loft(
    Curves=[graft_3, graft_4],
    Options={Adjust=False, Closed=False, LoftEnds=0, LoftSimp=0, LoftType=0, Rebuild=10, Refit=0.01})
crv_25 = Curve(flatten(graft_4))
data_47 = Data(data_37)
explode_3 = Explode(Curve=join_6, Recursive=True)  # -> Segments, Vertices
join_7 = BrepJoin(Breps=flatten(loft))  # -> Breps, Closed
divide_2 = DivideCurve(Curve=explode_3.Segments, Count=data_47, Kinks=False)  # -> Points, Tangents, Parameters
cap = CapHoles(Brep=join_7.Breps)
trim_10 = TrimTree(Tree=divide_2.Points, Depth=1)

pline_11 = PolyLine(Vertices=trim_10, Closed=False)
cp_5 = ControlPoints(Curve=pline_11)  # -> Points, Weights, Knots

brep = Brep(cap)
nurbs_3 = NurbsCurve(Vertices=cp_5.Points, Degree=3, Periodic=False)  # -> Curve, Length, Domain
len_4 = Length(Curve=nurbs_3.Curve)
division_6 = Division(A=len_4, B=2)
ext_3 = ExtendCurve(Curve=nurbs_3.Curve, Type=2, Start=division_6, End=division_6)  # -> flatten(Curve)
crv_26 = Curve()
end_15 = EndPoints(Curve=ext_3)  # -> Start, End
data_48 = Data(ext_3)
ln_9 = Line(StartPoint=end_15.Start, EndPoint=end_15.End)
join_8 = JoinCurves(Curves=[ln_9, data_48], Preserve=False)
boundary = BoundarySurfaces(Edges=join_8)
neg_4 = Negative(Value="60")
offset = OffsetSurface(Surface=graft(boundary), Distance=["60", neg_4], Retrim=True)
geo_2 = Geometry(brep)
loft_2 = Loft(Curves=offset, Options={Adjust=False, Closed=False, LoftEnds=0, LoftSimp=0, LoftType=0, Rebuild=10, Refit=0.01})
dispatch = Dispatch(List=flatten(loft_2), DispatchPattern=[True, False])  # -> ListA, ListB
geo_3 = Geometry(loft_2)
cap_2 = CapHoles(Brep=geo_3)
sdiff = SolidDifference(BrepsA=flatten(brep), BrepsB=flatten(cap_2))
brep_2 = Brep(sdiff)
bbox = BoundingBox(Content=brep_2, Plane=PlaneXY(0, 0, 0))  # -> Box, Box_2
crv_27 = Curve(crv_25)
volume = Volume(Geometry=bbox.Box)  # -> Volume, Centroid
mirror_2 = Mirror(Geometry=crv_27, Plane=data_32)  # -> Geometry, Transform
sort = SortList(Keys=volume.Volume, ValuesA=brep_2)  # -> Keys, reverse(ValuesA)
item_15 = ListItem(List=sort.ValuesA, Index=0, Wrap=True)
geo_4 = Geometry(flatten(item_15))
mirror_3 = Mirror(Geometry=geo_4, Plane=data_32)  # -> Geometry, Transform
crv_28 = Curve([crv_27, mirror_2.Geometry])
data_49 = Data(mirror_3.Geometry)
data_50 = Data(geo_4)
relay_11 = Relay([data_50, data_49])
rad_2 = Radians(Degrees=D)
data_51 = Data(pipe)
trim_11 = TrimTree(Tree=data_51, Depth=1)
rotate_4 = Rotate(Geometry=relay_11, Angle=rad_2, Plane=pt_3)  # -> Geometry, Transform
rotate_5 = Rotate(Geometry=trim_11, Angle=rad_2, Plane=pt_3)  # -> Geometry, Transform
debrep = DeconstructBrep(Brep=rotate_4.Geometry)  # -> Faces, Edges, Vertices
crv_29 = Curve(debrep.Faces)
planar = Planar(Curve=crv_29)  # -> Planar, Plane, Deviation
cull = CullPattern(List=crv_29, CullPattern=planar.Planar)
brep_3 = Brep(rotate_4.Geometry)
brep_4 = Brep(rotate_5.Geometry)
crv_30 = Curve(cull)
color = ClusterOutput(pt_4)
brep_5 = ClusterOutput(brep_3)
brep_6 = ClusterOutput(brep_4)
crv_31 = ClusterOutput(crv_30)

# ==== cluster Cluster_4
data = ClusterInput()
data_2 = Data(data)
pt = Point(data_2)
round = Round(Number=data_2)  # -> Nearest, Floor, Ceiling
null = NullItem(Item=pt)  # -> NullFlags, InvalidFlags, Description
p_n_c = PickNChoose(Pattern=null.NullFlags, Stream0=pt, Stream1=round.Nearest)
panel = Panel(pt)
R = ClusterOutput(p_n_c)

# ==== cluster Cluster_5
graph = ClusterInput()
B = ClusterInput()
graph_2 = GraphMapper(
    graph,
    x0=0,
    x1=1,
    y0=0,
    y1=1,
    container_name="Bezier",
    cpx=[0, 0.459231168, 0.5282088518, 1],
    cpy=[0, 0.03727918863, 0.8716881871, 1])
multiplication = Multiplication(A=graph_2, B=B)
data = Data(multiplication)
data_2 = ClusterOutput(data)
